# Grasshopper definition 140311_brickGeneration_bottomup_Dan_v2.ghx (Grasshopper 0.9.70)
# plug-ins: Python Interpreter, Kangaroo Components, HDTReference, LunchBox

attractorpoint = Geometry(<point referenced from the Rhino model>)
activate = BooleanToggle(False)

# ---- group: INPUTS / Surface Geometry Input
geo = Geometry(<brep referenced from the Rhino model>)

# ----
filter = StreamFilter(Gate=activate, Stream1=geo)

# ---- group: INPUTS / Brick geometry inputs
brick_center = Point(<point referenced from the Rhino model>)
brick_axis = Point(<point referenced from the Rhino model>)
brick = Mesh(<mesh referenced from the Rhino model>)

# ----
minimum_brick_bearing = Slider(4, range=0..12)

# ---- group: CONSTANTS
inches_in_a_foot = Panel("12")
brick_height = Slider(4, range=0..12)
brick_width = Slider(16, range=0..20)
brick_height_2 = Data(brick_height)
brick_width_2 = Data(brick_width)
inches_in_a_foot_2 = Number(inches_in_a_foot)

# ----
brick_height_3 = Data(brick_height)
inches_in_a_foot_3 = Number(inches_in_a_foot)
surface = Geometry(filter)

# ---- group: Contour Generation
pt = ConstructPoint(XCoordinate=0, YCoordinate=0, ZCoordinate=Slider(0.25, range=0..1))
division = Division(A=brick_height_3, B=inches_in_a_foot_3)
Z = UnitZ(Factor=1)
contour = Contour(Shape=surface, Point=pt, Direction=Z, Distance=division)  # -> simplify(Contours)

# ----
minbrickbearing = Data(minimum_brick_bearing)
panel = Panel("text")

# ---- group: Select Contours
number_slider = Slider(13, range=0..120)
number_slider_2 = Slider(0, range=0..100)
addition = Addition(A=number_slider_2, B=number_slider)
series = Series(Start=number_slider_2, Step=1, Count=number_slider)
branch = TreeBranch(Tree=contour, Path=series, MaintainPaths=True)
subtraction = Subtraction(A=addition, B=Slider(1, range=0..1))

# ----
showcurves = BooleanToggle(False)
python_t_gh_f = BooleanToggle(False)
filter_2 = StreamFilter(Gate=showcurves, Stream1=contour)
filter_3 = StreamFilter(Gate=python_t_gh_f, Stream0=branch)
preview = CustomPreview(Geometry=filter_2, Shader=ColourSwatch(SwatchColor=RGB(255, 112, 112)))
geo_2 = Geometry(flatten(filter_3))
brick_width_3 = Data(brick_width)

# ---- group: Get Path Indeces
tstat = TreeStatistics(Tree=filter_3)  # -> Paths, Length, Count

# ----
lng = ListLength(List=filter_3)
genes = GenePool(Decimals=0, Maximum=1000000, Minimum=0, Value=[557062, 379013, 509110, 499610, 384639, 526988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])
len = Length(Curve=geo_2)
lng_2 = ListLength(List=geo_2)
division_2 = Division(A=brick_width_3, B="12")

# ---- group: PythonStacking
contourcurves = Data(flatten(branch))
min_spacing = Slider(0, range=0..1)
max_spacing = Slider(0.24, range=0..1)
minbrickbearing_2 = Data(minimum_brick_bearing)
inches_in_a_foot_4 = Number(inches_in_a_foot)
inches_in_a_foot_5 = Number(inches_in_a_foot)
brick_width_4 = Data(brick_width)
path = FilePath("D:\Dropbox\_Projects\2014 Projects\theliving_ps1\140311_brick_laying\BrickStacker\BrickPatternGenerator.py")
division_3 = Division(A=minbrickbearing_2, B=inches_in_a_foot_4)
dom = ConstructDomain(DomainStart=min_spacing, DomainEnd=max_spacing)
division_4 = Division(A=brick_width_4, B=inches_in_a_foot_5)
file = ReadFile(File=path, PerLineParse=False)

# ----
division_5 = Division(A=len, B=division_2)

# ---- group: Convert level to boolean logic
dpath = DeconstructPath(Branch=tstat.Paths)  # -> simplify(Indices)
mod = Modulus(A=dpath, B=Slider(2, range=0..10))
repeat = RepeatData(Data=mod, Length=lng)  # -> graft(Data)
not = GateNot(A=repeat)

# ----
round = Round(Number=division_5)  # -> Nearest, Floor, Ceiling
panel_2 = Panel("C:\Users\Danil\Desktop\export\")
split = SplitList(List=genes, Index=number_slider)  # -> ListA, ListB
data = Data(round.Floor)
series_2 = Series(Start=0, Step=1, Count=lng_2)
filter_4 = StreamFilter(Gate=python_t_gh_f, Stream1=contourcurves)
int = Integer(graft(split.ListA))

# ---- group: Create random seeds
lng_3 = ListLength(List=tstat.Paths)
dom_2 = ConstructDomain(DomainStart=Slider(0, range=0..100), DomainEnd=Slider(1000000, range=0..1000000))
random = Random(Range=dom_2, Number=lng_3, Seed=Slider(134628, range=0..1000000), Integers=True)  # -> graft(Random)
repeat_2 = RepeatData(Data=int, Length=lng)  # -> simplify(Data)

# ----
subtraction_2 = Subtraction(A=data, B=series_2)
attractorpoint_2 = Geometry(attractorpoint)
inches_in_a_foot_6 = Number(inches_in_a_foot)
brick_width_5 = Data(brick_width)
multiplication = Multiplication(A=subtraction_2, B=division_2)

# ---- group: Create Brick Spacing
min_spacing_2 = Slider(0, range=0..1)
max_spacing_2 = Slider(0.49, range=0..1)
number_slider_3 = Slider(100, range=0..100)
division_6 = Division(A=brick_width_5, B=inches_in_a_foot_6)
dom_3 = ConstructDomain(DomainStart=min_spacing_2, DomainEnd=max_spacing_2)
random_2 = Random(Range=dom_3, Number=number_slider_3, Seed=repeat_2)  # -> simplify(Random)
series_3 = Series(Start=Slider(0, range=0..10), Step=division_6, Count=number_slider_3)
ma = MassAddition(Input=random_2)  # -> Result, PartialResults
addition_2 = Addition(A=series_3, B=ma.PartialResults)

# ----
item = ListItem(List=flatten(int), Index=0, Wrap=True)  # disabled

# ---- group: PythonStacking
placebricks = PythonScript(
    Code=file,
    ContourCurves=filter_4,
    BrickWidth=division_4,
    GapDomain=dom,
    MinBearing=division_3,
    AttractorPoint=attractorpoint_2)  # -> Out, BrickPattern, BrickPoints, BrickRotation, BrickVectors, DebugList, DebugList2

# ----
panel_3 = Panel("C:\Users\Danil\Desktop\export\")  # disabled
galapagos = Galapagos(fitness=ma_3, gene=genes)
panel_4 = Panel(series_2)
subtraction_3 = Subtraction(A=len, B=multiplication)
number_slider_4 = Slider(0, range=0..100)
panel_5 = Panel(not)
larger = LargerThan(FirstNumber=item, SecondNumber=item)  # -> LargerThan, OrEqualTo; disabled
toggle = BooleanToggle(True)  # disabled
series_4 = Series(Start=0, Step=1, Count=Slider(5, range=0..10))
division_7 = Division(A=subtraction_3, B=subtraction_2)
counter = Counter(Reset=larger.LargerThan)  # disabled
geo_3 = Geometry()
panel_6 = Panel(series_4)
addition_3 = Addition(A=division_2, B=division_7)
python = PythonScript(x=item, active=toggle, filePath=panel_3, current=counter)  # -> out, C; disabled
# ---------- python: Python ----------
import rhinoscriptsyntax as rs

if active:
    
    savedLocation = filePath + str(int(current)).zfill(4) + ".png"
    rs.Command("_-ViewCaptureToFile \n\"" + savedLocation + "\"\n_enter")
    
    C = True
else:
    C = False
# ---------- end python ----------
python_2 = PythonScript()  # -> out, a; disabled
# ---------- python_2: Python ----------
import rhinoscriptsyntax as rs

rs.CurveClosestPoint(
# ---------- end python_2 ----------
gaps = Panel(addition_3)

# ---- group: Offset for odd levels
division_8 = Division(A=division_6, B=Slider(2, range=0..10))
multiplication_2 = Multiplication(A=repeat, B=division_8)

# ----
exploredebuglist = Slider(15, range=0..41)
data_2 = Data(placebricks.DebugList)
divlength = DivideLength(Curve=geo_2, Length=addition_3)  # -> Points, Tangents, Parameters
flatten = FlattenTree(Tree=data_2, Path="{0}")
sift = SiftPattern(List=flatten, SiftPattern=panel_6)  # -> Output0, Output1, Output2, Output3, Output4, Output5, Output6
clean = CleanTree(Tree=sift.Output4, CleanInvalid=True, CleanEmpty=False)
clean_2 = CleanTree(Tree=sift.Output2, CleanInvalid=True, CleanEmpty=False)
clean_3 = CleanTree(Tree=sift.Output3, CleanInvalid=True, CleanEmpty=False)
clean_4 = CleanTree(Tree=sift.Output0, CleanInvalid=True, CleanEmpty=False)
clean_5 = CleanTree(Tree=sift.Output1, CleanInvalid=True, CleanEmpty=False)
realvec = Vector(clean_2)
panel_7 = Panel(clean)
showalldebug = BooleanToggle(True)

# ---- group: Instantiate Brick Geometry / Brick geometry inputs
brick_center_2 = Point(brick_center)
brick_axis_2 = Point(brick_axis)
brick_2 = Mesh(brick)

# ----
crv_cp = CurveClosestPoint(Point=clean_5, Curve=clean_4)  # -> Point, Parameter, Distance
eval = EvaluateCurve(Curve=graft(filter_4), Parameter=placebricks.BrickPattern)  # -> Point, Tangent, Angle
xy = XYPlane(Origin=Point(0, 0, 0))
eval_2 = EvaluateCurve(Curve=clean_4, Parameter=crv_cp.Parameter)  # -> Point, Tangent, Angle
X = UnitX(Factor=1)
Z_2 = UnitZ(Factor=1)

# ---- group: Offset for even levels
multiplication_3 = Multiplication(A=not, B=division_6)

# ----
data_3 = Data(placebricks.DebugList2)
branch_2 = TreeBranch(Tree=data_2, Path=exploredebuglist, MaintainPaths=True)
filter_5 = StreamFilter(Gate=showalldebug, Stream0=branch_2, Stream1=data_2)
Z_3 = UnitZ(Factor=1)
python_3 = PythonScript()  # -> out, a
# ---------- python_3: Python ----------
import rhinoscriptsyntax as rs

rs.CurvePerpFrame(
# ---------- end python_3 ----------
angle = Angle(VectorA=eval_2.Tangent, VectorB=realvec, Plane=xy)  # -> Angle, Reflex
rev = Reverse(Vector=X)
geo_4 = Geometry(simplify(divlength.Points))
filter_6 = StreamFilter(Gate=showalldebug, Stream0=branch_2, Stream1=data_2)

# ---- group: Instantiate Brick Geometry / Brick geometry inputs
brick_center_3 = Point(brick_center)
brick_axis_3 = Point(brick_axis)
brick_3 = Mesh(brick)

# ----
eval_3 = EvaluateCurve(Curve=graft(filter_4), Parameter=placebricks.BrickPattern)  # -> Point, Tangent, Angle
panel_8 = Panel(angle.Angle)
panel_9 = Panel(data_3)
vdisex = VectorDisplayEx(Point=eval_2.Point, Vector=clean_2, Colour=ColourSwatch(SwatchColor=RGB(79, 255, 237)), Width=2)
python_4 = PythonScript()  # -> out, a
# ---------- python_4: Python ----------
import rhinoscriptsyntax as rs

import ghpythonlib.components as ghcomp

ghcomp.LengthParameter(
# ---------- end python_4 ----------
item_2 = ListItem(List=random_2, Index=0, Wrap=True)
vrot = Rotate(Vector=eval_2.Tangent, Axis=Z_2, Angle=angle.Angle)

# ---- group: Calculate target curve length
addition_4 = Addition(A=multiplication_2, B=multiplication_3)
addition_5 = Addition(A=addition_4, B=item_2)
lengths_of_curves = Length(Curve=branch)
subtraction_4 = Subtraction(A=graft(lengths_of_curves), B=addition_5)  # -> simplify(Result)

# ----
vdis = VectorDisplay(Anchor=eval_2.Point, Vector=realvec)
vdisex_2 = VectorDisplayEx(Point=eval_2.Point, Vector=vrot, Colour=ColourSwatch(SwatchColor=RGB(255, 79, 79)), Width=2)
Z_4 = UnitZ(Factor=1)
eval_4 = EvaluateLength(Normalized=True)  # -> Point, Tangent, Parameter
vdis_2 = VectorDisplay(Anchor=eval_2.Point, Vector=vrot)
geo_5 = Geometry(simplify(eval_3.Point))

# ---- group: Instantiate Brick Geometry
brickrotation = Data(placebricks.BrickRotation)
brickvectors = Vector(placebricks.BrickVectors)
vec2pt = Vector2Pt(PointA=brick_center_3, PointB=brick_axis_3, Unitize=False)  # -> Vector, Length
unit = UnitVector(Vector=vec2pt.Vector)
txt = Text(brickvectors)
vec = Vector(txt)
orient = OrientDirection(Geometry=brick_3, PointA=brick_center_3, DirectionA=unit, PointB=geo_5, DirectionB=vec)  # -> Geometry, Transform

# ----
previewlw = CustomPreviewLineweights(Geometry=filter_6, Shader=ColourSwatch(SwatchColor=RGB(255, 225, 0)), Thickness=Slider(4, range=0..10))
vrot_2 = Rotate(Vector=eval_3.Tangent, Axis=Z_4, Angle=brickrotation)  # -> simplify(Vector)
panel_10 = Panel(vrot_2)
X_2 = UnitX(Factor=1)

# ---- group: Instantiate Brick Geometry
brickrotation_2 = Data(placebricks.BrickRotation)
brickvectors_2 = Vector(placebricks.BrickVectors)
vec2pt_2 = Vector2Pt(PointA=brick_center_2, PointB=brick_axis_2, Unitize=False)  # -> Vector, Length
vec_2 = Vector(divlength.Tangents)
unit_2 = UnitVector(Vector=vec2pt_2.Vector)
txt_2 = Text(brickvectors_2)
orient_2 = OrientDirection(Geometry=brick_2, PointA=brick_center_2, DirectionA=unit_2, PointB=geo_4, DirectionB=X_2)  # -> Geometry, Transform

# ----
vrot_3 = Rotate(Vector=eval.Tangent, Axis=Z_3, Angle=brickrotation_2)  # -> simplify(Vector)
panel_11 = Panel(addition_2)
panel_12 = Panel(lengths_of_curves)

# ---- group: Add offset to brick spacing
addition_6 = Addition(A=multiplication_2, B=addition_2)

# ----
align = AlignPlane()  # -> Plane, Angle
X_3 = UnitX(Factor=1)

# ---- group: Cull list to target length
smaller = SmallerThan(FirstNumber=addition_6, SecondNumber=subtraction_4)  # -> SmallerThan, OrEqualTo
cull = CullPattern(List=addition_6, CullPattern=smaller.OrEqualTo)

# ----
placedbrickgeometry = Geometry(orient.Geometry)
first = Panel(placebricks.Out)

# ---- group: Calculate remainder and add to spacing list
item_3 = ListItem(List=reverse(cull), Index=0, Wrap=True)
lng_4 = ListLength(List=cull)
subtraction_5 = Subtraction(A=subtraction_4, B=simplify(item_3))
division_9 = Division(A=subtraction_5, B=simplify(lng_4))
series_5 = Series(Start=0, Step=division_9, Count=simplify(lng_4))  # -> simplify(Series)
addition_7 = Addition(A=cull, B=series_5)  # -> simplify(Result)

# ----
viewer = ParamViewer(division_9)
txt_3 = Text(first)
txt_4 = Text(simplify(graft(txt_3)))
tmatch = MatchText(Text=txt_3, Pattern="COURSEMARKER", Case=True)
item_4 = ListItem(AllContours=contour, Index=0, Wrap=True)  # -> flatten(Item)
level_logic = Integer(mod)
ma_2 = MassAddition(Input=tmatch)  # -> Result, PartialResults
viewer_2 = ParamViewer(txt_4)
rad = Radians(Degrees=Slider(45, range=0..100))
lng_5 = ListLength(List=item_4)
panel_13 = Panel(ma_2.PartialResults)
txt_5 = Text(first)
multiplication_4 = Multiplication(A=level_logic, B="2")
panel_14 = Panel(viewer_2)
split_2 = SplitList(List=reverse(txt_5), Index=Slider(20, range=0..100))  # -> reverse(ListA), ListB
last = Panel(split_2.ListA)
range = Range(Domain=rad, Steps=lng_5)  # -> simplify(graft(Range))
path_2 = ConstructPath(Indices=graft(panel_13))  # -> simplify(Branch)
panel_15 = Panel(path_2)
subtraction_6 = Subtraction(A=multiplication_4, B="1")

# ---- group: Brick geometry inputs
brick_center_4 = Point(brick_center)
brick_axis_4 = Point(brick_axis)
brick_4 = Mesh(brick)

# ----
crossref = CrossReference(CrossMode=1)  # -> ListA, ListB
all = Panel(placebricks.Out)
Z_5 = UnitZ(Factor=1)
eval_5 = EvaluateLength(Normalized=True)  # -> Point, Tangent, Parameter
brickpointspython = Data(placebricks.BrickPoints)
placedbrickgeometrypython = Geometry(placedbrickgeometry)
curve_geometry = Geometry(branch)
analyzeplacedbricks = BooleanToggle(False)
analyze = Boolean(analyzeplacedbricks)
placebricks_2 = BooleanToggle(True)
bake = Button()
showpoints = BooleanToggle(False)
placebricks_3 = Boolean(placebricks_2)
swatch = ColourSwatch(SwatchColor=RGB(255, 112, 112))

# ---- group: Instantiate Brick Geometry
brickpattern = Number(addition_7)
curve_geometry_2 = Geometry(branch)
vec2pt_3 = Vector2Pt(PointA=brick_center_4, PointB=brick_axis_4, Unitize=False)  # -> Vector, Length
eval_6 = EvaluateLength(Curve=graft(curve_geometry_2), Length=brickpattern, Normalized=Toggle(False))  # -> Point, Tangent, Parameter
unit_3 = UnitVector(Vector=vec2pt_3.Vector)

# ----
panel_16 = Panel(curve_geometry_2)
pshift = ShiftPaths(Data=eval_6.Point, Offset=-1)
pshift_2 = ShiftPaths(Data=eval_6.Tangent, Offset=-1)
brickpointsgh = Data(pshift)
filter_7 = StreamFilter(Gate=python_t_gh_f, Stream0=brickpointsgh, Stream1=brickpointspython)
brickpoints = Data(filter_7)
filter_8 = StreamFilter(Gate=analyzeplacedbricks, Stream1=brickpoints)
filter_9 = StreamFilter(Gate=showpoints, Stream1=brickpoints)
brickpoints_2 = Data(filter_8)
preview_2 = CustomPreview(Geometry=filter_9, Shader=swatch)

# ---- group: Generate closest point on curve above
path_3 = ConstructPath(Indices=subtraction)
path_4 = ConstructPath(Indices=number_slider_2)
split_3 = SplitTree(Data=curve_geometry, Masks=flatten(path_4))  # -> Positive, Negative
split_4 = SplitTree(Data=brickpoints, Masks=flatten(path_3))  # -> Positive, Negative
lng_6 = ListLength(List=split_4.Negative)
lng_7 = ListLength(List=split_3.Negative)
dup = DuplicateData(Data=lng_7, Number=lng_6, Order=True)  # -> simplify(graft(Data))
graft = GraftTree(Tree=split_4.Negative, IncludeEmptyLists=True, IncludeNullItems=True)
dup_2 = DuplicateData(Data=graft, Number=dup, Order=True)  # -> simplify(Data)
path_mapper = PathMapper(dup_2, source="{A;B}(i)", target="{A;i}")
crv_cp_2 = CurveClosestPoint(Point=path_mapper, Curve=graft(split_3.Negative))  # -> Point, Parameter, Distance
path_mapper_2 = PathMapper(crv_cp_2.Point, source="{A;B}(i)", target="{A;i}")
path_mapper_3 = PathMapper(crv_cp_2.Distance, source="{A;B}(i)", target="{A;i}")
sort = SortList(Keys=path_mapper_3, ValuesA=path_mapper_2)  # -> Keys, ValuesA
item_5 = ListItem(List=sort.ValuesA, Index="0", Wrap=True)

# ---- group: Generate closest points on level above
path_5 = ConstructPath(Indices=subtraction)
path_6 = ConstructPath(Indices=number_slider_2)
split_5 = SplitTree(Data=brickpoints_2, Masks=flatten(path_6))  # -> Positive, Negative
split_6 = SplitTree(Data=brickpoints_2, Masks=flatten(path_5))  # -> Positive, Negative
cps = ClosestPoints(Point=split_6.Negative, Cloud=split_5.Negative, Count=Slider(2, range=0..30))  # -> ClosestPoint, CPIndex, Distance

# ----
panel_17 = Panel(cps.CPIndex)

# ---- group: Generate closest point distances in XY plane
pdecon = Deconstruct(Point=graft(split_4.Negative))  # -> XComponent, YComponent, ZComponent
pdecon_2 = Deconstruct(Point=graft(item_5))  # -> XComponent, YComponent, ZComponent
pt_2 = ConstructPoint(XCoordinate=pdecon_2.XComponent, YCoordinate=pdecon_2.YComponent, ZCoordinate=0)
pt_3 = ConstructPoint(XCoordinate=pdecon.XComponent, YCoordinate=pdecon.YComponent, ZCoordinate=0)
dist = Distance(PointA=pt_2, PointB=pt_3)  # -> simplify(Distance)

# ---- group: Specify Rotation Type
rotation_by_level = Number(range)

# ---- group: Generate closest point distances in XY plane
item_6 = ListItem(List=cps.ClosestPoint, Index="1", Wrap=True)
pdecon_3 = Deconstruct(Point=split_6.Negative)  # -> XComponent, YComponent, ZComponent
pt_4 = ConstructPoint(XCoordinate=pdecon_3.XComponent, YCoordinate=pdecon_3.YComponent, ZCoordinate=0)

# ----
pshift_3 = ShiftPaths(Data=item_6, Offset=-1)

# ---- group: Generate closest point distances in XY plane (continued)
pdecon_4 = Deconstruct(Point=pshift_3)  # -> XComponent, YComponent, ZComponent
pt_5 = ConstructPoint(XCoordinate=pdecon_4.XComponent, YCoordinate=pdecon_4.YComponent, ZCoordinate=0)
dist_2 = Distance(PointA=pt_5, PointB=pt_4)  # -> simplify(Distance)

# ---- group: Find neighbor distance
item_7 = ListItem(List=cps.CPIndex, Index="0", Wrap=True)
split_7 = SplitTree(Data=dist_2, Masks=flatten(path_6))  # -> Positive, Negative
pshift_4 = ShiftPaths(Data=item_7, Offset=-1)
item_8 = ListItem(List=split_7.Negative, Index=pshift_4, Wrap=True)

# ---- group: Test for bearing cutoff distance
larger_2 = LargerThan(FirstNumber=item_8, SecondNumber=Slider(1.2, range=0..2))  # -> LargerThan, OrEqualTo
larger_3 = LargerThan(FirstNumber=dist_2, SecondNumber=Slider(1.2, range=0..2))  # -> LargerThan, OrEqualTo
and = GateAnd(A=larger_2.LargerThan, B=larger_3.LargerThan)
addition_8 = Addition(A=and, B=larger_3.LargerThan)
ma_3 = MassAddition(Input=flatten(and))  # -> Result, PartialResults
division_10 = Division(A=addition_8, B="2")

# ---- group: Remap maximum bearing
sort_2 = SortList(Keys=flatten(dist_2))  # -> Keys, ValuesA
item_9 = ListItem(List=sort_2.Keys, Index=0, Wrap=True)
dom_4 = ConstructDomain(DomainStart=item_9, DomainEnd=Slider(2, range=0..2))
remap = RemapNumbers(Value=dist_2, Source=dom_4, Target=Domain(0, 1))  # -> Mapped, Clipped

# ----
failed_bricks = Panel(ma_3.Result)

# ---- group: Remove top row
smaller_2 = SmallerThan(FirstNumber=dist, SecondNumber=Slider(1, range=0..1))  # -> SmallerThan, OrEqualTo
pshift_5 = ShiftPaths(Data=smaller_2.SmallerThan, Offset=-1)
cull_2 = CullPattern(List=dist, CullPattern=smaller_2.SmallerThan)

# ---- group: Remap 0ffset
number_slider_5 = Slider(0.2, range=0..2)
sort_3 = SortList(Keys=flatten(cull_2))  # -> Keys, ValuesA
item_10 = ListItem(List=sort_3.Keys, Index=0, Wrap=True)

# ----
item_11 = ListItem(List=reverse(sort_3.Keys), Index=0, Wrap=True)

# ---- group: Remap 0ffset (continued)
dom_5 = ConstructDomain(DomainStart=item_10, DomainEnd=item_11)
remap_2 = RemapNumbers(Value=cull_2, Source=dom_5, Target=Domain(0, 1))  # -> Mapped, Clipped

# ----
pshift_6 = ShiftPaths(Data=remap_2.Mapped, Offset=-1)
multiplication_5 = Multiplication(A=pshift_6, B=rad)

# ---- group: Specify Rotation Type (continued)
rotation_by_offset = Number(multiplication_5)

# ----
multiplication_6 = Multiplication(A=rotation_by_offset, B=subtraction_6)
vrot_4 = Rotate(Vector=pshift_2, Axis=Z_5, Angle=multiplication_6)

# ---- group: Instantiate Brick Geometry (continued)
orient_3 = OrientDirection(Geometry=brick_4, PointA=brick_center_4, DirectionA=unit_3, PointB=pshift, DirectionB=vrot_4)  # -> Geometry, Transform

# ----
placedbrickgeometrygh = Geometry(orient_3.Geometry)
filter_10 = StreamFilter(Gate=python_t_gh_f, Stream0=placedbrickgeometrygh, Stream1=placedbrickgeometrypython)
placedbrickgeometry_2 = Geometry(filter_10)
filter_11 = StreamFilter(Gate=analyzeplacedbricks, Stream1=placedbrickgeometry_2)
filter_12 = StreamFilter(Gate=placebricks_3, Stream1=placedbrickgeometry_2)
medges = MeshEdges(Mesh=flatten(filter_12))  # -> NakedEdges, InteriorEdges, NonManifoldEdges
placedbrickgeometry_3 = Geometry(filter_11)
bake_2 = ObjectBake(
    BakeToggle=bake,
    GeometryObjects=placedbrickgeometry_2,
    Layer="GH_Bake",
    ObjectName="GH_Obj",
    ObjectColor=swatch,
    LayerColor=RGB(255, 255, 255))
preview_3 = CustomPreview(Geometry=filter_12, Shader=ColourSwatch(SwatchColor=RGBA(32, 43, 38, 238)))
preview_4 = CustomPreview(
    Geometry=[medges.NakedEdges, medges.InteriorEdges, medges.NonManifoldEdges],
    Shader=ColourSwatch(SwatchColor=RGBA(133, 133, 133, 238)))

# ---- group: Remove top row (continued)
brick_geometry = Mesh(placedbrickgeometry_3)
cull_3 = CullPattern(List=brick_geometry, CullPattern=pshift_5)

# ----
brick_geometry_2 = Mesh(placedbrickgeometry_3)

# ---- group: Create output geometry
gradient = Gradient(LowerLimit=0, UpperLimit=1, Parameter=flatten(division_10), stops=[0.424: RGB(92, 165, 204), 0.788: RGB(255, 0, 0)])
brick_geometry_3 = Mesh(flatten(brick_geometry_2))
mcol = MeshColours(Mesh=graft(brick_geometry_3), Colours=graft(gradient))
medges_2 = MeshEdges(Mesh=mcol)  # -> NakedEdges, InteriorEdges, NonManifoldEdges
preview_5 = CustomPreview(Geometry=[medges_2.NakedEdges, medges_2.InteriorEdges], Shader=ColourSwatch(SwatchColor=RGB(61, 61, 61)))

gradient_2 = Gradient(
    LowerLimit=0,
    UpperLimit=1,
    Parameter=flatten(remap_2.Mapped),
    stops=[0: RGB(0, 128, 0), 0.419: RGB(255, 255, 0), 1: RGB(255, 0, 0)])
brick_geometry_4 = Mesh(flatten(cull_3))
mcol_2 = MeshColours(Mesh=graft(brick_geometry_4), Colours=graft(gradient_2))

# ----
preview_6 = CustomPreview(Geometry=flatten(split_4.Negative), Shader=gradient)
preview_7 = CustomPreview(Geometry=flatten(split_4.Negative), Shader=gradient_2)
lng_8 = ListLength(List=brick_geometry_3)
total_bricks = Panel(lng_8)
division_11 = Division(A=failed_bricks, B=total_bricks)
multiplication_7 = Multiplication(A="100", B=division_11)
round_2 = Round(Number=multiplication_7)  # -> Nearest, Floor, Ceiling
concat = Concatenate(FragmentA=round_2.Nearest, FragmentB="% failure")
panel_18 = Panel(concat)
