# Grasshopper definition 140325_brickGeneration_topdown_Dan.ghx (Grasshopper 0.9.70)
# plug-ins: Python Interpreter, LunchBox

activate = BooleanToggle(True)

# ---- group: INPUTS / Surface Geometry Input
geo = Geometry([<brep referenced from the Rhino model> x3])

# ----
centerpoint = Geometry(<point referenced from the Rhino model>)
filter = StreamFilter(Gate=activate, Stream1=geo)

# ---- group: INPUTS / Brick geometry inputs
brick_center = Point(<point referenced from the Rhino model>)
brick_axis = Point(<point referenced from the Rhino model>)
brick = Mesh(<mesh referenced from the Rhino model>)

# ----
minimum_brick_bearing = Slider(4, range=0..12)

# ---- group: CONSTANTS
inches_in_a_foot = Panel("12")
brick_height = Slider(8, range=0..12)
brick_width = Slider(16, range=0..20)
brick_height_2 = Data(brick_height)
inches_in_a_foot_2 = Number(inches_in_a_foot)
brick_width_2 = Data(brick_width)
division = Division(A=brick_height_2, B=inches_in_a_foot)
division_2 = Division(A=brick_width_2, B=inches_in_a_foot)
brick_height_inch = Data(brick_height)

# ----
brick_height_3 = Data(brick_height)
inches_in_a_foot_3 = Number(inches_in_a_foot)
surface = Geometry(filter)

# ---- group: Contour Generation
pt = ConstructPoint(XCoordinate=0, YCoordinate=0, ZCoordinate=Slider(0.25, range=0..1))
division_3 = Division(A=brick_height_3, B=inches_in_a_foot_3)
Z = UnitZ(Factor=1)
contour = Contour(Shape=surface, Point=pt, Direction=Z, Distance=division_3)  # -> simplify(Contours)

# ----
minbrickbearing = Data(minimum_brick_bearing)

showcurves = BooleanToggle(True)
filter_2 = StreamFilter(Gate=showcurves, Stream1=contour)
preview = CustomPreview(Geometry=filter_2, Shader=ColourSwatch(SwatchColor=RGB(255, 112, 112)))

# ---- group: Select Contours
number_slider = Slider(41, range=0..120)
number_slider_2 = Slider(0, range=0..100)
series = Series(Start=number_slider_2, Step=1, Count=number_slider)
addition = Addition(A=number_slider_2, B=number_slider)
branch = TreeBranch(Tree=contour, Path=series, MaintainPaths=True)
subtraction = Subtraction(A=addition, B=Slider(1, range=0..1))

# ----
brick_width_inch = Data(division_2)
panel = Panel(contour)
cluster = Cluster(geo=contour)
geo_2 = Geometry(cluster)
python_t_gh_f = BooleanToggle(False)
filter_3 = StreamFilter(Gate=python_t_gh_f, Stream0=contour)
edges = BrepEdges(Brep=filter)  # -> Naked, Interior, NonManifold
horizontalcurves = HorizontalCurves(geo=edges.Naked)  # -> A, B
geo_3 = Geometry(filter_3)
geo_4 = Geometry(flatten(geo_3))
crv = Curve(<curve referenced from the Rhino model>)
centerpoint_2 = Geometry(centerpoint)
geo_5 = Geometry(<brep referenced from the Rhino model>)
split = SplitList(List=geo_4, Index=Slider(30, range=0..30))  # -> ListA, ListB
coursingcount = Slider(3, range=0..4)
end = EndPoints(Curve=geo_3)  # -> Start, End
pt_2 = Point(end.Start)
volume = Volume(Geometry=geo_5)  # -> Volume, Centroid
geo_6 = Geometry(flatten(geo_3))
curvepoint = PointOnCurve(geo_6, parameter=0.5)
vec = Vector(crv)
planrvectowardscenter = PlanrVecTowardsCenter(P=centerpoint_2, pt=pt_2)
geo_7 = Geometry(flatten(geo_6))
dist = Distance(PointA=curvepoint, PointB=volume.Centroid)
series_2 = Series(Start=0, Step=1, Count=coursingcount)
brick_height_inch_2 = Data(brick_height_inch)
brick_width_inch_2 = Data(brick_width_inch)
line = LineSDL(Start=end.Start, Direction=vec, Length=Slider(33, range=0..100))
cbrt = CubeRoot(Value=dist)
getalignvectors = GetAlignVectors(geo=geo_7, C=horizontalcurves.B)  # -> V_2, V
sqrt = SquareRoot(Value=dist)
sqr = Square(Value=cbrt)
division_4 = Division(A=brick_width_inch_2, B=coursingcount)
end_2 = EndPoints(Curve=geo_7)  # -> Start, End
brickgap = Slider(0, range=0..1)
geo_8 = Geometry(flatten(filter_3))  # disabled
dom = ConstructDomain(DomainStart=Slider(0.3, range=0..1), DomainEnd=Slider(0, range=0..1))
brick_width_3 = Data(brick_width)  # disabled

# ---- group: Get Path Indeces
tstat = TreeStatistics(Tree=filter_3)  # -> Paths, Length, Count; disabled

# ----
bnd = Bounds(Numbers=sqr)
series_3 = Series(Start=0, Step=division_4, Count=coursingcount)
number_slider_3 = Slider(5, range=0..10)
lng = ListLength(List=filter_3)  # disabled
len = Length(Curve=geo_8)  # disabled
stepamount = Panel(series_3)
lng_2 = ListLength(List=geo_8)  # disabled
division_5 = Division(A=brick_width_3, B="12")  # disabled
vdis = VectorDisplay(Anchor=end_2.End, Vector=getalignvectors.V)
vdis_2 = VectorDisplay(Anchor=end_2.Start, Vector=getalignvectors.V_2)
remap = RemapNumbers(Value=sqr, Source=bnd, Target=dom)  # -> Mapped, Clipped
addition_2 = Addition(A=brick_width_inch_2, B=brickgap)
division_6 = Division(A=len, B=division_5)  # disabled
len_2 = Length(Curve=geo_6)

# ---- group: Convert level to boolean logic
number_slider_4 = Slider(2, range=0..10)  # disabled
dpath = DeconstructPath(Branch=tstat.Paths)  # -> simplify(Indices); disabled
mod = Modulus(A=dpath, B=number_slider_4)  # disabled
repeat = RepeatData(Data=mod, Length=lng)  # -> graft(Data); disabled
not = GateNot(A=repeat)  # disabled

# ----
round = Round(Number=division_6)  # -> Nearest, Floor, Ceiling; disabled
division_7 = Division(A=len_2, B=addition_2)
split_2 = SplitList(Index=number_slider)  # -> ListA, ListB; disabled
data = Data(round.Floor)  # disabled
series_4 = Series(Start=0, Step=1, Count=lng_2)  # disabled
round_2 = Round(Number=division_7)  # -> Nearest, Floor, Ceiling
int = Integer(graft(split_2.ListA))  # disabled

# ---- group: Create random seeds
number_slider_5 = Slider(0, range=0..100)  # disabled
number_slider_6 = Slider(1000000, range=0..1000000)  # disabled
number_slider_7 = Slider(134628, range=0..1000000)  # disabled
lng_3 = ListLength(List=tstat.Paths)  # disabled
dom_2 = ConstructDomain(DomainStart=number_slider_5, DomainEnd=number_slider_6)  # disabled
random = Random(Range=dom_2, Number=lng_3, Seed=number_slider_7, Integers=True)  # -> graft(Random); disabled
repeat_2 = RepeatData(Data=int, Length=lng)  # -> simplify(Data); disabled

# ----
panel_2 = Panel(len_2)
number_slider_8 = Slider(3, range=0..10)
subtraction_2 = Subtraction(A=data, B=series_4)  # disabled
lng_4 = ListLength(List=round_2.Ceiling)
panel_3 = Panel(remap.Mapped)
repeat_3 = RepeatData(Data=series_3, Length=lng_4)
inches_in_a_foot_4 = Number(inches_in_a_foot)  # disabled
brick_width_4 = Data(brick_width)  # disabled
multiplication = Multiplication(A=subtraction_2, B=division_5)  # disabled

# ---- group: Create Brick Spacing
min_spacing = Slider(0, range=0..1)  # disabled
max_spacing = Slider(0.49, range=0..1)  # disabled
number_slider_9 = Slider(100, range=0..100)  # disabled
number_slider_10 = Slider(0, range=0..10)  # disabled
division_8 = Division(A=brick_width_4, B=inches_in_a_foot_4)  # disabled
dom_3 = ConstructDomain(DomainStart=min_spacing, DomainEnd=max_spacing)  # disabled
random_2 = Random(Range=dom_3, Number=number_slider_9, Seed=repeat_2)  # -> simplify(Random); disabled
series_5 = Series(Start=number_slider_10, Step=division_8, Count=number_slider_9)  # disabled
ma = MassAddition(Input=random_2)  # -> Result, PartialResults; disabled
addition_3 = Addition(A=series_5, B=ma.PartialResults)  # disabled

# ----
item = ListItem(List=flatten(int), Index=0, Wrap=True)  # disabled
panel_4 = Panel(series_4)  # disabled
Z_2 = UnitZ(Factor=1)
subtraction_3 = Subtraction(A=len, B=multiplication)  # disabled
series_6 = Series(Start=repeat_3, Step=addition_2, Count=round_2.Ceiling)  # -> simplify(Series)
graft = GraftTree(Tree=geo_6, IncludeEmptyLists=True, IncludeNullItems=True)  # -> simplify(Tree)
eval = EvaluateLength(Curve=reparameterize(graft), Length=series_6, Normalized=False)  # -> Point, Tangent, Parameter
data_2 = Data(eval.Parameter)
subtraction_4 = Subtraction(A="1", B=data_2)
multiplication_2 = Multiplication(A=data_2, B=getalignvectors.V)
multiplication_3 = Multiplication(A=subtraction_4, B=getalignvectors.V_2)
panel_5 = Panel(data_2)
subtraction_5 = Subtraction(A=eval.Parameter, B="0.5")
addition_4 = Addition(A=multiplication_3, B=multiplication_2)
abs = Absolute(Value=subtraction_5)
panel_6 = Panel(not)  # disabled
eval_2 = EvaluateLength(Curve=graft(geo_6), Length=Slider(21.211, range=0..30), Normalized=False)  # -> Point, Tangent, Parameter
division_9 = Division(A=addition_4, B="2")
sqr_2 = Square(Value=abs)
rad = Radians(Degrees=Slider(-90, range=-100..100))
panel_7 = Panel(graft)
unit = UnitVector(Vector=division_9)
division_10 = Division(A=subtraction_3, B=subtraction_2)  # disabled
multiplication_4 = Multiplication(A=abs, B="2")
vrot = Rotate(Vector=eval.Tangent, Axis=Z_2, Angle=rad)
bnd_2 = Bounds(Numbers=sqr_2)
eval_3 = EvaluateLength(Curve=graft, Length=series_6, Normalized=False)  # -> Point, Tangent, Parameter
addition_5 = Addition(A=division_5, B=division_10)  # disabled
endvectorsgradient = Panel(unit)
unit_2 = UnitVector(Vector=vrot)
remap_2 = RemapNumbers(Value=sqr_2, Source=bnd_2, Target=Domain(0, 1))  # -> Mapped, Clipped
vdis_3 = VectorDisplay(Anchor=eval.Point, Vector=unit_2)
weights = Panel(remap_2.Mapped)
gaps = Panel(addition_5)  # disabled

# ---- group: Offset for odd levels
number_slider_11 = Slider(2, range=0..10)  # disabled
division_11 = Division(A=division_8, B=number_slider_11)  # disabled
multiplication_5 = Multiplication(A=repeat, B=division_11)  # disabled

# ----
line_2 = LineSDL(Start=eval_3.Point, Direction=eval_3.Tangent, Length=1)
vdis_4 = VectorDisplay(Anchor=eval_3.Point, Vector=eval_3.Tangent)
bricklinevectors = Panel(unit_2)
divlength = DivideLength(Curve=geo_8, Length=addition_5)  # -> Points, Tangents, Parameters; disabled
filter_4 = StreamFilter(Gate=0)  # disabled

# ---- group: Instantiate Brick Geometry / Brick geometry inputs
brick_center_2 = Point(brick_center)  # disabled
brick_axis_2 = Point(brick_axis)  # disabled
brick_2 = Mesh(brick)  # disabled

# ----
eval_4 = EvaluateCurve()  # -> Point, Tangent, Angle; disabled

# ---- group: Offset for even levels
multiplication_6 = Multiplication(A=not, B=division_8)  # disabled

# ----
Z_3 = UnitZ(Factor=1)  # disabled
python = PythonScript()  # -> out, a; disabled
# ---------- python: Python ----------
import rhinoscriptsyntax as rs

rs.CurvePerpFrame(
# ---------- end python ----------
geo_9 = Geometry(simplify(divlength.Points))  # disabled
subtraction_6 = Subtraction(A="1", B=remap_2.Mapped)
data_3 = Data(remap_2.Mapped)
vdis_5 = VectorDisplay(Anchor=eval.Point, Vector=unit)
item_2 = ListItem(List=random_2, Index=0, Wrap=True)  # disabled

# ---- group: Calculate target curve length
addition_6 = Addition(A=multiplication_5, B=multiplication_6)  # disabled
addition_7 = Addition(A=addition_6, B=item_2)  # disabled
lengths_of_curves = Length(Curve=branch)  # disabled
subtraction_7 = Subtraction(A=graft(lengths_of_curves), B=addition_7)  # -> simplify(Result); disabled

# ----
angle = Angle(VectorA=unit_2, VectorB=unit)  # -> Angle, Reflex
multiplication_7 = Multiplication(A=unit_2, B=subtraction_6)
multiplication_8 = Multiplication(A=unit, B=data_3)
placebricks = PlaceBricks(
    brick=brick,
    brick_center=brick_center,
    brick_axis=brick_axis,
    point=eval_3.Point,
    vector=eval_3.Tangent,
    G=Toggle(False))
avr = Average(Input=angle.Angle)
addition_8 = Addition(A=multiplication_7, B=multiplication_8)
X = UnitX(Factor=1)  # disabled

# ---- group: Instantiate Brick Geometry
brickrotation = Data()  # disabled
brickvectors = Vector()  # disabled
vec2pt = Vector2Pt(PointA=brick_center_2, PointB=brick_axis_2, Unitize=False)  # -> Vector, Length; disabled
vec_2 = Vector(divlength.Tangents)  # disabled
unit_3 = UnitVector(Vector=vec2pt.Vector)  # disabled
txt = Text(brickvectors)  # disabled
orient = OrientDirection(Geometry=brick_2, PointA=brick_center_2, DirectionA=unit_3, PointB=geo_9, DirectionB=X)  # -> Geometry, Transform; disabled

# ----
vrot_2 = Rotate(Vector=eval_4.Tangent, Axis=Z_3, Angle=brickrotation)  # -> simplify(Vector); disabled
panel_8 = Panel(addition_3)  # disabled
panel_9 = Panel(avr)
panel_10 = Panel(lengths_of_curves)  # disabled

# ---- group: Add offset to brick spacing
addition_9 = Addition(A=multiplication_5, B=addition_3)  # disabled

# ----
division_12 = Division(A=addition_8, B="2")
unit_4 = UnitVector(Vector=division_12)
gaps_2 = Panel(addition_5)

# ---- group: Cull list to target length
smaller = SmallerThan(FirstNumber=addition_9, SecondNumber=subtraction_7)  # -> SmallerThan, OrEqualTo; disabled
cull = CullPattern(List=addition_9, CullPattern=smaller.OrEqualTo)  # disabled

# ----
blendedvectors = Panel(unit_4)
geo_10 = Geometry(placebricks)
Z_4 = UnitZ(Factor=1)

# ---- group: Calculate remainder and add to spacing list
item_3 = ListItem(List=reverse(cull), Index=0, Wrap=True)  # disabled
lng_5 = ListLength(List=cull)  # disabled
subtraction_8 = Subtraction(A=subtraction_7, B=simplify(item_3))  # disabled
division_13 = Division(A=subtraction_8, B=simplify(lng_5))  # disabled
series_7 = Series(Start=0, Step=division_13, Count=simplify(lng_5))  # -> simplify(Series); disabled
addition_10 = Addition(A=cull, B=series_7)  # -> simplify(Result); disabled

# ----
viewer = ParamViewer(division_13)  # disabled
rad_2 = Radians(Degrees=Slider(90, range=-100..100))
vrot_3 = Rotate(Vector=unit_4, Axis=Z_4, Angle=rad_2)
number_slider_12 = Slider(45, range=0..100)  # disabled
item_4 = ListItem(AllContours=contour, Index=0, Wrap=True)  # -> flatten(Item); disabled
level_logic = Integer(mod)  # disabled
panel_11 = Panel("1")  # disabled
panel_12 = Panel("2")  # disabled
placebricks_2 = PlaceBricks(brick=brick, brick_center=brick_center, brick_axis=brick_axis, point=eval.Point, vector=vrot_3, G=Toggle(True))
rad_3 = Radians(Degrees=number_slider_12)  # disabled
lng_6 = ListLength(List=item_4)  # disabled
multiplication_9 = Multiplication(A=level_logic, B=panel_12)  # disabled
range = Range(Domain=rad_3, Steps=lng_6)  # -> simplify(graft(Range)); disabled
subtraction_9 = Subtraction(A=multiplication_9, B=panel_11)  # disabled
geo_11 = Geometry()
preview_2 = CustomPreview(Geometry=placebricks_2, Shader=ColourSwatch(SwatchColor=RGB(156, 156, 156)))

# ---- group: Brick geometry inputs
brick_center_3 = Point(brick_center)  # disabled
brick_axis_3 = Point(brick_axis)  # disabled
brick_3 = Mesh(brick)  # disabled

# ----
Z_5 = UnitZ(Factor=1)  # disabled
eval_5 = EvaluateLength(Normalized=True)  # -> Point, Tangent, Parameter; disabled
brickpointspython = Data()  # disabled
placedbrickgeometrypython = Geometry()  # disabled
curve_geometry = Geometry(branch)  # disabled
analyzeplacedbricks = BooleanToggle(False)  # disabled
analyze = Boolean(analyzeplacedbricks)  # disabled
placebricks_3 = BooleanToggle(True)  # disabled
bake = Button()  # disabled
showpoints = BooleanToggle(False)  # disabled
placebricks_4 = Boolean(placebricks_3)  # disabled
swatch = ColourSwatch(SwatchColor=RGB(255, 112, 112))  # disabled
swatch_2 = ColourSwatch(SwatchColor=RGBA(133, 133, 133, 238))  # disabled
swatch_3 = ColourSwatch(SwatchColor=RGBA(32, 43, 38, 238))  # disabled
number_slider_13 = Slider(1, range=0..1)  # disabled

# ---- group: Instantiate Brick Geometry
brickpattern = Number(addition_10)  # disabled
toggle = BooleanToggle(False)  # disabled
curve_geometry_2 = Geometry(branch)  # disabled
vec2pt_2 = Vector2Pt(PointA=brick_center_3, PointB=brick_axis_3, Unitize=False)  # -> Vector, Length; disabled
eval_6 = EvaluateLength(Curve=graft(curve_geometry_2), Length=brickpattern, Normalized=toggle)  # -> Point, Tangent, Parameter; disabled
unit_5 = UnitVector(Vector=vec2pt_2.Vector)  # disabled

# ----
panel_13 = Panel(curve_geometry_2)  # disabled
pshift = ShiftPaths(Data=eval_6.Point, Offset=-1)  # disabled
pshift_2 = ShiftPaths(Data=eval_6.Tangent, Offset=-1)  # disabled
brickpointsgh = Data(pshift)  # disabled
filter_5 = StreamFilter(Gate=python_t_gh_f, Stream0=brickpointsgh, Stream1=brickpointspython)  # disabled
brickpoints = Data(filter_5)  # disabled
filter_6 = StreamFilter(Gate=analyzeplacedbricks, Stream1=brickpoints)  # disabled
filter_7 = StreamFilter(Gate=showpoints, Stream1=brickpoints)  # disabled
brickpoints_2 = Data(filter_6)  # disabled
preview_3 = CustomPreview(Geometry=filter_7, Shader=swatch)  # disabled

# ---- group: Generate closest point on curve above
path = ConstructPath(Indices=subtraction)  # disabled
path_2 = ConstructPath(Indices=number_slider_2)  # disabled
split_3 = SplitTree(Data=curve_geometry, Masks=flatten(path_2))  # -> Positive, Negative; disabled
split_4 = SplitTree(Data=brickpoints, Masks=flatten(path))  # -> Positive, Negative; disabled
lng_7 = ListLength(List=split_4.Negative)  # disabled
lng_8 = ListLength(List=split_3.Negative)  # disabled
dup = DuplicateData(Data=lng_8, Number=lng_7, Order=True)  # -> simplify(graft(Data)); disabled
graft_2 = GraftTree(Tree=split_4.Negative, IncludeEmptyLists=True, IncludeNullItems=True)  # disabled
dup_2 = DuplicateData(Data=graft_2, Number=dup, Order=True)  # -> simplify(Data); disabled
path_mapper = PathMapper(dup_2, source="{A;B}(i)", target="{A;i}")  # disabled
crv_cp = CurveClosestPoint(Point=path_mapper, Curve=graft(split_3.Negative))  # -> Point, Parameter, Distance; disabled
path_mapper_2 = PathMapper(crv_cp.Point, source="{A;B}(i)", target="{A;i}")  # disabled
path_mapper_3 = PathMapper(crv_cp.Distance, source="{A;B}(i)", target="{A;i}")  # disabled
sort = SortList(Keys=path_mapper_3, ValuesA=path_mapper_2)  # -> Keys, ValuesA; disabled
panel_14 = Panel("0")  # disabled
item_5 = ListItem(List=sort.ValuesA, Index=panel_14, Wrap=True)  # disabled

# ---- group: Generate closest points on level above
path_3 = ConstructPath(Indices=subtraction)  # disabled
path_4 = ConstructPath(Indices=number_slider_2)  # disabled
number_slider_14 = Slider(2, range=0..30)  # disabled
split_5 = SplitTree(Data=brickpoints_2, Masks=flatten(path_4))  # -> Positive, Negative; disabled
split_6 = SplitTree(Data=brickpoints_2, Masks=flatten(path_3))  # -> Positive, Negative; disabled
cps = ClosestPoints(Point=split_6.Negative, Cloud=split_5.Negative, Count=number_slider_14)  # -> ClosestPoint, CPIndex, Distance; disabled

# ----
panel_15 = Panel(cps.CPIndex)  # disabled

# ---- group: Generate closest point distances in XY plane
pdecon = Deconstruct(Point=graft(split_4.Negative))  # -> XComponent, YComponent, ZComponent; disabled
pdecon_2 = Deconstruct(Point=graft(item_5))  # -> XComponent, YComponent, ZComponent; disabled
pt_3 = ConstructPoint(XCoordinate=pdecon_2.XComponent, YCoordinate=pdecon_2.YComponent, ZCoordinate=0)  # disabled
pt_4 = ConstructPoint(XCoordinate=pdecon.XComponent, YCoordinate=pdecon.YComponent, ZCoordinate=0)  # disabled
dist_2 = Distance(PointA=pt_3, PointB=pt_4)  # -> simplify(Distance); disabled

# ---- group: Specify Rotation Type
rotation_by_level = Number(range)  # disabled

# ---- group: Generate closest point distances in XY plane
panel_16 = Panel("1")  # disabled
item_6 = ListItem(List=cps.ClosestPoint, Index=panel_16, Wrap=True)  # disabled
pdecon_3 = Deconstruct(Point=split_6.Negative)  # -> XComponent, YComponent, ZComponent; disabled
pt_5 = ConstructPoint(XCoordinate=pdecon_3.XComponent, YCoordinate=pdecon_3.YComponent, ZCoordinate=0)  # disabled

# ----
pshift_3 = ShiftPaths(Data=item_6, Offset=-1)  # disabled

# ---- group: Generate closest point distances in XY plane (continued)
pdecon_4 = Deconstruct(Point=pshift_3)  # -> XComponent, YComponent, ZComponent; disabled
pt_6 = ConstructPoint(XCoordinate=pdecon_4.XComponent, YCoordinate=pdecon_4.YComponent, ZCoordinate=0)  # disabled
dist_3 = Distance(PointA=pt_6, PointB=pt_5)  # -> simplify(Distance); disabled

# ---- group: Find neighbor distance
panel_17 = Panel("0")  # disabled
item_7 = ListItem(List=cps.CPIndex, Index=panel_17, Wrap=True)  # disabled
split_7 = SplitTree(Data=dist_3, Masks=flatten(path_4))  # -> Positive, Negative; disabled
pshift_4 = ShiftPaths(Data=item_7, Offset=-1)  # disabled
item_8 = ListItem(List=split_7.Negative, Index=pshift_4, Wrap=True)  # disabled

# ---- group: Test for bearing cutoff distance
number_slider_15 = Slider(1.2, range=0..2)  # disabled
number_slider_16 = Slider(1.2, range=0..2)  # disabled
larger = LargerThan(FirstNumber=item_8, SecondNumber=number_slider_16)  # -> LargerThan, OrEqualTo; disabled
larger_2 = LargerThan(FirstNumber=dist_3, SecondNumber=number_slider_15)  # -> LargerThan, OrEqualTo; disabled
and = GateAnd(A=larger.LargerThan, B=larger_2.LargerThan)  # disabled
addition_11 = Addition(A=and, B=larger_2.LargerThan)  # disabled
panel_18 = Panel("2")  # disabled
ma_2 = MassAddition(Input=flatten(and))  # -> Result, PartialResults; disabled
division_14 = Division(A=addition_11, B=panel_18)  # disabled

# ---- group: Remap maximum bearing
number_slider_17 = Slider(2, range=0..2)  # disabled
sort_2 = SortList(Keys=flatten(dist_3))  # -> Keys, ValuesA; disabled
item_9 = ListItem(List=sort_2.Keys, Index=0, Wrap=True)  # disabled
dom_4 = ConstructDomain(DomainStart=item_9, DomainEnd=number_slider_17)  # disabled
remap_3 = RemapNumbers(Value=dist_3, Source=dom_4, Target=Domain(0, 1))  # -> Mapped, Clipped; disabled

# ----
failed_bricks = Panel(ma_2.Result)  # disabled

# ---- group: Remove top row
smaller_2 = SmallerThan(FirstNumber=dist_2, SecondNumber=number_slider_13)  # -> SmallerThan, OrEqualTo; disabled
pshift_5 = ShiftPaths(Data=smaller_2.SmallerThan, Offset=-1)  # disabled
cull_2 = CullPattern(List=dist_2, CullPattern=smaller_2.SmallerThan)  # disabled

# ---- group: Remap 0ffset
number_slider_18 = Slider(0.2, range=0..2)  # disabled
sort_3 = SortList(Keys=flatten(cull_2))  # -> Keys, ValuesA; disabled
item_10 = ListItem(List=sort_3.Keys, Index=0, Wrap=True)  # disabled

# ----
item_11 = ListItem(List=reverse(sort_3.Keys), Index=0, Wrap=True)  # disabled

# ---- group: Remap 0ffset (continued)
dom_5 = ConstructDomain(DomainStart=item_10, DomainEnd=item_11)  # disabled
remap_4 = RemapNumbers(Value=cull_2, Source=dom_5, Target=Domain(0, 1))  # -> Mapped, Clipped; disabled

# ----
pshift_6 = ShiftPaths(Data=remap_4.Mapped, Offset=-1)  # disabled
multiplication_10 = Multiplication(A=pshift_6, B=rad_3)  # disabled

# ---- group: Specify Rotation Type (continued)
rotation_by_offset = Number(multiplication_10)  # disabled

# ----
multiplication_11 = Multiplication(A=rotation_by_offset, B=subtraction_9)  # disabled
vrot_4 = Rotate(Vector=pshift_2, Axis=Z_5, Angle=multiplication_11)  # disabled

# ---- group: Instantiate Brick Geometry (continued)
orient_2 = OrientDirection(Geometry=brick_3, PointA=brick_center_3, DirectionA=unit_5, PointB=pshift, DirectionB=vrot_4)  # -> Geometry, Transform; disabled

# ----
placedbrickgeometrygh = Geometry(orient_2.Geometry)  # disabled
filter_8 = StreamFilter(Gate=python_t_gh_f, Stream0=placedbrickgeometrygh, Stream1=placedbrickgeometrypython)  # disabled
placedbrickgeometry = Geometry(filter_8)  # disabled
filter_9 = StreamFilter(Gate=analyzeplacedbricks, Stream1=placedbrickgeometry)  # disabled
filter_10 = StreamFilter(Gate=placebricks_4, Stream1=placedbrickgeometry)  # disabled
medges = MeshEdges(Mesh=flatten(filter_10))  # -> NakedEdges, InteriorEdges, NonManifoldEdges; disabled
placedbrickgeometry_2 = Geometry(filter_9)  # disabled
bake_2 = ObjectBake(
    BakeToggle=bake,
    GeometryObjects=placedbrickgeometry,
    Layer="GH_Bake",
    ObjectName="GH_Obj",
    ObjectColor=swatch,
    LayerColor=RGB(255, 255, 255))  # disabled
preview_4 = CustomPreview(Geometry=filter_10, Shader=swatch_3)  # disabled
preview_5 = CustomPreview(Geometry=[medges.NakedEdges, medges.InteriorEdges, medges.NonManifoldEdges], Shader=swatch_2)  # disabled

# ---- group: Remove top row (continued)
brick_geometry = Mesh(placedbrickgeometry_2)  # disabled
cull_3 = CullPattern(List=brick_geometry, CullPattern=pshift_5)  # disabled

# ----
brick_geometry_2 = Mesh(placedbrickgeometry_2)  # disabled

# ---- group: Create output geometry
gradient = Gradient(LowerLimit=0, UpperLimit=1, Parameter=flatten(division_14), stops=[0.424: RGB(92, 165, 204), 0.788: RGB(255, 0, 0)])  # disabled
brick_geometry_3 = Mesh(flatten(brick_geometry_2))  # disabled
mcol = MeshColours(Mesh=graft(brick_geometry_3), Colours=graft(gradient))  # disabled
medges_2 = MeshEdges(Mesh=mcol)  # -> NakedEdges, InteriorEdges, NonManifoldEdges; disabled
swatch_4 = ColourSwatch(SwatchColor=RGB(61, 61, 61))  # disabled
preview_6 = CustomPreview(Geometry=[medges_2.NakedEdges, medges_2.InteriorEdges], Shader=swatch_4)  # disabled

gradient_2 = Gradient(
    LowerLimit=0,
    UpperLimit=1,
    Parameter=flatten(remap_4.Mapped),
    stops=[0: RGB(0, 128, 0), 0.419: RGB(255, 255, 0), 1: RGB(255, 0, 0)])  # disabled
brick_geometry_4 = Mesh(flatten(cull_3))  # disabled
mcol_2 = MeshColours(Mesh=graft(brick_geometry_4), Colours=graft(gradient_2))  # disabled

# ----
preview_7 = CustomPreview(Geometry=flatten(split_4.Negative), Shader=gradient)  # disabled
preview_8 = CustomPreview(Geometry=flatten(split_4.Negative), Shader=gradient_2)  # disabled
lng_9 = ListLength(List=brick_geometry_3)  # disabled
total_bricks = Panel(lng_9)  # disabled
division_15 = Division(A=failed_bricks, B=total_bricks)  # disabled
multiplication_12 = Multiplication(A="100", B=division_15)
round_3 = Round(Number=multiplication_12)  # -> Nearest, Floor, Ceiling
concat = Concatenate(FragmentA=round_3.Nearest, FragmentB="% failure")
panel_19 = Panel(concat)

# ==== cluster HorizontalCurves
geo = ClusterInput()
geo_2 = Geometry(geo)
planar = Planar(Curve=geo_2)  # -> Planar, Plane, Deviation
xy = XYPlane(Origin=Point(0, 0, 0))
dprod = DotProduct(VectorA=planar.Plane, VectorB=xy, Unitize=False)
xprod = CrossProduct(VectorA=planar.Plane, VectorB=xy, Unitize=False)  # -> Vector, Length
abs = Absolute(Value=dprod)
panel = Panel("1")
larger = LargerThan(FirstNumber=abs, SecondNumber=Slider(0.5, range=0..1))  # -> LargerThan, OrEqualTo
dispatch = Dispatch(List=geo_2, DispatchPattern=larger.LargerThan)  # -> ListA, ListB
panel_2 = Panel(dispatch.ListA)
A = ClusterOutput(dispatch.ListA)
B = ClusterOutput(dispatch.ListB)

# ==== cluster PlanrVecTowardsCenter
P = ClusterInput()
pt = ClusterInput()
pt_2 = Point(pt)
pdecon = Deconstruct(Point=P)  # -> XComponent, YComponent, ZComponent
pdecon_2 = Deconstruct(Point=pt_2)  # -> XComponent, YComponent, ZComponent
pt_3 = ConstructPoint(XCoordinate=pdecon.XComponent, YCoordinate=pdecon.YComponent, ZCoordinate=pdecon_2.ZComponent)
vec2pt = Vector2Pt(PointA=pt_2, PointB=pt_3, Unitize=False)  # -> Vector, Length
unit = UnitVector(Vector=vec2pt.Vector)
V = ClusterOutput(unit)

# ==== cluster PlaceBricks
point = ClusterInput()
vector = ClusterInput()
brick_center = ClusterInput()
G = ClusterInput()
brick_axis = ClusterInput()
brick = ClusterInput()
point_2 = Geometry(point)
vector_2 = Data(vector)

# ---- group: Instantiate Brick Geometry / Brick geometry inputs
brick_center_2 = Point(brick_center)
brick_axis_2 = Point(brick_axis)
brick_2 = Mesh(brick)

# ----
geo = Geometry(simplify(point_2))
filter = StreamFilter(Gate=G, Stream1=brick_2)

# ---- group: Instantiate Brick Geometry
vec2pt = Vector2Pt(PointA=brick_center_2, PointB=brick_axis_2, Unitize=False)  # -> Vector, Length
vec = Vector(vector_2)
unit = UnitVector(Vector=vec2pt.Vector)
orient = OrientDirection(Geometry=filter, PointA=brick_center_2, DirectionA=unit, PointB=geo, DirectionB=vec)  # -> Geometry, Transform

# ----
G_2 = ClusterOutput(orient.Geometry)

# ==== cluster GetAlignVectors
C = ClusterInput()
geo = ClusterInput()
end = EndPoints(Curve=graft(C))  # -> Start, End
geo_2 = Geometry(C)
item = ListItem(List=C, Index=0, Wrap=True)
sort_pt = SortPoints(Points=[end.Start, end.End])  # -> Points, Indices
geo_3 = Geometry(geo)
split = SplitList(List=sort_pt.Points, Index="1")  # -> ListA, ListB
panel = Panel(split.ListA)
item_2 = ListItem(List=reverse(geo_3), Index=0, Wrap=True)
item_3 = ListItem(List=geo_3, Index=0, Wrap=True)
pt = Point(split.ListB)
pdecon = Deconstruct(Point=split.ListA)  # -> XComponent, YComponent, ZComponent
pdecon_2 = Deconstruct(Point=pt)  # -> XComponent, YComponent, ZComponent
end_2 = EndPoints(Curve=item_3)  # -> Start, End
crv_cp = CurveClosestPoint(Point=end_2.Start, Curve=C)  # -> Point, Parameter, Distance
end_3 = EndPoints(Curve=item_2)  # -> Start, End
pt_2 = ConstructPoint(XCoordinate=pdecon.XComponent, YCoordinate=pdecon.YComponent, ZCoordinate=pdecon_2.ZComponent)
vec2pt = Vector2Pt(PointA=pt_2, PointB=pt, Unitize=False)  # -> Vector, Length
vec2pt_2 = Vector2Pt(PointA=end_2.End, PointB=end_3.End, Unitize=False)  # -> Vector, Length
vec2pt_3 = Vector2Pt(PointA=end_2.Start, PointB=end_3.Start, Unitize=False)  # -> Vector, Length
vdis = VectorDisplay(Anchor=split.ListA, Vector=vec2pt.Vector)
unit = UnitVector(Vector=vec2pt.Vector)  # -> simplify(flatten(Vector))
devec = DeconstructVector(Vector=vec2pt_3.Vector)  # -> XComponent, YComponent, ZComponent
devec_2 = DeconstructVector(Vector=vec2pt_2.Vector)  # -> XComponent, YComponent, ZComponent
vec = VectorXYZ(XComponent=devec.XComponent, YComponent=devec.YComponent, ZComponent=0)  # -> Vector, Length
vec_2 = VectorXYZ(XComponent=devec_2.XComponent, YComponent=devec_2.YComponent, ZComponent=0)  # -> Vector, Length
line = LineSDL(Start=end_2.Start, Direction=vec.Vector, Length=1)
line_2 = LineSDL(Start=end_2.End, Direction=vec_2.Vector, Length=1)
llx = LineLine(Line1=line, Line2=line_2)  # -> ParamA, ParamB, PointA, PointB
vec2pt_4 = Vector2Pt(PointA=end_2.End, PointB=llx.PointB, Unitize=False)  # -> Vector, Length
vec2pt_5 = Vector2Pt(PointA=end_2.Start, PointB=llx.PointA, Unitize=False)  # -> Vector, Length
unit_2 = UnitVector(Vector=vec2pt_4.Vector)
unit_3 = UnitVector(Vector=vec2pt_5.Vector)
vdis_2 = VectorDisplay(Anchor=end_2.End, Vector=unit_2)
vdis_3 = VectorDisplay(Anchor=end_2.Start, Vector=unit_3)
V = ClusterOutput(unit_2)
V_2 = ClusterOutput(unit_3)
panel_2 = Panel(vec.Vector)

# ==== cluster Cluster
geo = ClusterInput()
geo_2 = Geometry(geo)
end = EndPoints(Curve=geo_2)  # -> Start, End
vec2pt = Vector2Pt(PointA=end.Start, PointB=end.End, Unitize=False)  # -> Vector, Length
geo_3 = ClusterOutput(geo_2)
vdis = VectorDisplay(Anchor=end.Start, Vector=vec2pt.Vector)
