# Grasshopper definition 140325_brickGeneration_topdown_Dan_v2.ghx (Grasshopper 0.9.72)
# plug-ins: Python Interpreter, HDTReference, LunchBox, setFlounderCamera, getFlounderCamera

activate = BooleanToggle(True)

# ---- group: INPUTS / Surface Geometry Input
geo = Geometry([<brep referenced from the Rhino model> x2])

# ----
centerpoint = Geometry(<point referenced from the Rhino model>)
clean = CleanTree(Tree=geo, CleanInvalid=True, CleanEmpty=False)

# ---- group: INPUTS / Brick geometry inputs
brick_center = Point(<point referenced from the Rhino model>)
brick_axis = Point(<point referenced from the Rhino model>)
brick = Mesh(<mesh referenced from the Rhino model>)

# ----
filter = StreamFilter(Gate=activate, Stream1=clean)
minimum_brick_bearing = Slider(4, range=0..12)

# ---- group: CONSTANTS
inches_in_a_foot = Panel("12")
brick_width = Slider(16, range=0..20)
brick_height = Slider(8, range=0..12)
brick_width_2 = Data(brick_width)
inches_in_a_foot_2 = Number(inches_in_a_foot)
brick_height_2 = Data(brick_height)
division = Division(A=brick_height_2, B=inches_in_a_foot)
division_2 = Division(A=brick_width_2, B=inches_in_a_foot)
brick_height_ft = Data(brick_height)

# ----
brick_height_3 = Data(brick_height)
inches_in_a_foot_3 = Number(inches_in_a_foot)
brick_depth = Slider(7, range=0..12)
surface = Geometry(filter)

# ---- group: Contour Generation
pt = ConstructPoint(XCoordinate=0, YCoordinate=0, ZCoordinate=Slider(0.25, range=0..1))
division_3 = Division(A=brick_height_3, B=inches_in_a_foot_3)
Z = UnitZ(Factor=1)
contour = Contour(Shape=surface, Point=pt, Direction=Z, Distance=division_3)  # -> simplify(Contours)

# ----
minbrickbearing = Data(minimum_brick_bearing)
brick_depth_2 = Data(brick_depth)

showcurves = BooleanToggle(True)
filter_2 = StreamFilter(Gate=showcurves, Stream1=contour)
preview = CustomPreview(Geometry=filter_2, Shader=ColourSwatch(SwatchColor=RGB(255, 112, 112)))

division_4 = Division(A=brick_depth_2, B=inches_in_a_foot)

# ---- group: Select Contours
number_slider = Slider(41, range=0..120)
number_slider_2 = Slider(0, range=0..100)
series = Series(Start=number_slider_2, Step=1, Count=number_slider)
addition = Addition(A=number_slider_2, B=number_slider)
branch = TreeBranch(Tree=contour, Path=series, MaintainPaths=True)
subtraction = Subtraction(A=addition, B=Slider(1, range=0..1))

# ----
brick_depth_ft = Data(division_4)
brick_width_ft = Data(division_2)
panel = Panel(contour)
cluster = Cluster(geo=contour)
geo_2 = Geometry(cluster)
python_t_gh_f = BooleanToggle(False)
filter_3 = StreamFilter(Gate=python_t_gh_f, Stream0=contour)
contourlines = Geometry(filter_3)
centerpoint_2 = Geometry(centerpoint)
geo_3 = Geometry(<brep referenced from the Rhino model>)
edges = BrepEdges(Brep=filter)  # -> Naked, Interior, NonManifold
coursingcount = Slider(3, range=0..4)
end = EndPoints(Curve=contourlines)  # -> Start, End
pt_2 = Point(end.Start)
volume = Volume(Geometry=geo_3)  # -> Volume, Centroid
geo_4 = Geometry(simplify(contourlines))
curvepoint = PointOnCurve(geo_4, parameter=0.5)
planrvectowardscenter = PlanrVecTowardsCenter(P=centerpoint_2, pt=pt_2)
horizontalcurves = HorizontalCurves(geo=edges.Naked)  # -> A, B
dist = Distance(PointA=curvepoint, PointB=volume.Centroid)
panel_2 = Panel(horizontalcurves.B)
cbrt = CubeRoot(Value=dist)
brick_height_ft_2 = Data(brick_height_ft)
brickgap = Slider(0.1, range=0..1)
sqrt = SquareRoot(Value=dist)
sqr = Square(Value=cbrt)
geo_5 = Geometry(flatten(geo_4))
geo_6 = Geometry(flatten(filter_3))  # disabled
dom = ConstructDomain(DomainStart=Slider(0.3, range=0..1), DomainEnd=Slider(0, range=0..1))
brick_width_3 = Data(brick_width)  # disabled

# ---- group: Get Path Indeces
tstat = TreeStatistics(Tree=filter_3)  # -> Paths, Length, Count; disabled

# ----
bnd = Bounds(Numbers=sqr)
lng = ListLength(List=filter_3)  # disabled
len = Length(Curve=geo_6)  # disabled
lng_2 = ListLength(List=geo_6)  # disabled
division_5 = Division(A=brick_width_3, B="12")  # disabled
remap = RemapNumbers(Value=sqr, Source=bnd, Target=dom)  # -> Mapped, Clipped
attractorbrickgap = Data(remap.Mapped)
coursingpattern = CoursingPattern(geo=geo_4, data=coursingcount, brick_width_inch=brick_width_ft, B=brickgap)
division_6 = Division(A=len, B=division_5)  # disabled
getalignvectorsfromframe = GetAlignVectorsFromFrame(geo=horizontalcurves.B)  # -> V, V_2
graft = GraftTree(Tree=geo_4, IncludeEmptyLists=True, IncludeNullItems=True)  # -> simplify(Tree)
getalignvectors = GetAlignVectors(geo=geo_5, C=horizontalcurves.B)  # -> V_2, V

# ---- group: Convert level to boolean logic
number_slider_3 = Slider(2, range=0..10)  # disabled
dpath = DeconstructPath(Branch=tstat.Paths)  # -> simplify(Indices); disabled
mod = Modulus(A=dpath, B=number_slider_3)  # disabled
repeat = RepeatData(Data=mod, Length=lng)  # -> graft(Data); disabled
not = GateNot(A=repeat)  # disabled

# ----
round = Round(Number=division_6)  # -> Nearest, Floor, Ceiling; disabled
split = SplitList(Index=number_slider)  # -> ListA, ListB; disabled
data = Data(round.Floor)  # disabled
series_2 = Series(Start=0, Step=1, Count=lng_2)  # disabled
end_2 = EndPoints(Curve=geo_5)  # -> Start, End
int = Integer(graft(split.ListA))  # disabled

# ---- group: Create random seeds
number_slider_4 = Slider(0, range=0..100)  # disabled
number_slider_5 = Slider(1000000, range=0..1000000)  # disabled
number_slider_6 = Slider(134628, range=0..1000000)  # disabled
lng_3 = ListLength(List=tstat.Paths)  # disabled
dom_2 = ConstructDomain(DomainStart=number_slider_4, DomainEnd=number_slider_5)  # disabled
random = Random(Range=dom_2, Number=lng_3, Seed=number_slider_6, Integers=True)  # -> graft(Random); disabled
repeat_2 = RepeatData(Data=int, Length=lng)  # -> simplify(Data); disabled

# ----
subtraction_2 = Subtraction(A=data, B=series_2)  # disabled
vdis = VectorDisplay(Anchor=end_2.End, Vector=getalignvectorsfromframe.V_2)
vdis_2 = VectorDisplay(Anchor=end_2.Start, Vector=getalignvectorsfromframe.V)
inches_in_a_foot_4 = Number(inches_in_a_foot)  # disabled
brick_width_4 = Data(brick_width)  # disabled
multiplication = Multiplication(A=subtraction_2, B=division_5)  # disabled

# ---- group: Create Brick Spacing
min_spacing = Slider(0, range=0..1)  # disabled
max_spacing = Slider(0.49, range=0..1)  # disabled
number_slider_7 = Slider(100, range=0..100)  # disabled
number_slider_8 = Slider(0, range=0..10)  # disabled
division_7 = Division(A=brick_width_4, B=inches_in_a_foot_4)  # disabled
dom_3 = ConstructDomain(DomainStart=min_spacing, DomainEnd=max_spacing)  # disabled
random_2 = Random(Range=dom_3, Number=number_slider_7, Seed=repeat_2)  # -> simplify(Random); disabled
series_3 = Series(Start=number_slider_8, Step=division_7, Count=number_slider_7)  # disabled
ma = MassAddition(Input=random_2)  # -> Result, PartialResults; disabled
addition_2 = Addition(A=series_3, B=ma.PartialResults)  # disabled

# ----
item = ListItem(List=flatten(int), Index=0, Wrap=True)  # disabled
eval = EvaluateLength(Curve=reparameterize(graft), Length=coursingpattern, Normalized=False)  # -> Point, Tangent, Parameter
panel_3 = Panel(series_2)  # disabled
subtraction_3 = Subtraction(A=len, B=multiplication)  # disabled
panel_4 = Panel(not)  # disabled
division_8 = Division(A=subtraction_3, B=subtraction_2)  # disabled
framevectors_x = FrameVectorsX(data=eval.Parameter, B=getalignvectorsfromframe.V, B_2=getalignvectorsfromframe.V_2)
brickvectors_x = BrickVectorsX(V=eval.Tangent)
weight_x = WeightX(A=eval.Parameter)
panel_5 = Panel(geo_4)
addition_3 = Addition(A=division_5, B=division_8)  # disabled
md_slider = MDSlider(
    slider_value=Point(0.9268292683, 0.5304878049, 0.5),
    SliderMode=0,
    x_domain=Domain(-1, 1),
    y_domain=Domain(-1, 1),
    z_domain=Domain(0, 1))
framevectors = Panel(framevectors_x)
bricklinevectors = Panel(brickvectors_x)
gaps = Panel(addition_3)  # disabled

# ---- group: Offset for odd levels
number_slider_9 = Slider(2, range=0..10)  # disabled
division_9 = Division(A=division_7, B=number_slider_9)  # disabled
multiplication_2 = Multiplication(A=repeat, B=division_9)  # disabled

# ----
divlength = DivideLength(Curve=geo_6, Length=addition_3)  # -> Points, Tangents, Parameters; disabled
filter_4 = StreamFilter(Gate=0)  # disabled

# ---- group: Instantiate Brick Geometry / Brick geometry inputs
brick_center_2 = Point(brick_center)  # disabled
brick_axis_2 = Point(brick_axis)  # disabled
brick_2 = Mesh(brick)  # disabled

# ----
eval_2 = EvaluateCurve()  # -> Point, Tangent, Angle; disabled
blendedvectors_x_w_x_b_x_1_w_x_f_x = BlendedVectorsXWXBX1WXFX(A_2=brickvectors_x, A=framevectors_x, data=weight_x)
lng_4 = ListLength(List=blendedvectors_x_w_x_b_x_1_w_x_f_x)
multiplication_3 = Multiplication(A=md_slider, B=Slider(20, range=0..100))

# ---- group: Offset for even levels
multiplication_4 = Multiplication(A=not, B=division_7)  # disabled

# ----
multiplication_5 = Multiplication(A=lng_4, B=Slider(5, range=0..10))
normalizedseries = NormalizedSeries(num=multiplication_5)
Z_2 = UnitZ(Factor=1)  # disabled
python = PythonScript()  # -> out, a; disabled
# ---------- python: Python ----------
import rhinoscriptsyntax as rs

rs.CurvePerpFrame(
# ---------- end python ----------
geo_7 = Geometry(graft)
geo_8 = Geometry(simplify(divlength.Points))  # disabled
item_2 = ListItem(List=random_2, Index=0, Wrap=True)  # disabled
curvelenatparam = CurveLenAtParam(C=reparameterize(geo_7), B=normalizedseries)  # -> simplify(R)
eval_3 = EvaluateCurve(Curve=reparameterize(geo_7), Parameter=normalizedseries)  # -> Point, Tangent, Angle
blendedvectors = Panel(blendedvectors_x_w_x_b_x_1_w_x_f_x)

# ---- group: Calculate target curve length
addition_4 = Addition(A=multiplication_2, B=multiplication_4)  # disabled
addition_5 = Addition(A=addition_4, B=item_2)  # disabled
lengths_of_curves = Length(Curve=branch)  # disabled
subtraction_4 = Subtraction(A=graft(lengths_of_curves), B=addition_5)  # -> simplify(Result); disabled

# ----
t = Data(normalizedseries)
framevectors_x_2 = FrameVectorsX(data=t, B=getalignvectorsfromframe.V, B_2=getalignvectorsfromframe.V_2)
brickvectors_x_2 = BrickVectorsX_2(V=eval_3.Tangent)
weight_x_2 = WeightX(A=t)
X = UnitX(Factor=1)  # disabled

# ---- group: Instantiate Brick Geometry
brickrotation = Data()  # disabled
brickvectors = Vector()  # disabled
vec2pt = Vector2Pt(PointA=brick_center_2, PointB=brick_axis_2, Unitize=False)  # -> Vector, Length; disabled
vec = Vector(divlength.Tangents)  # disabled
unit = UnitVector(Vector=vec2pt.Vector)  # disabled
txt = Text(brickvectors)  # disabled
orient = OrientDirection(Geometry=brick_2, PointA=brick_center_2, DirectionA=unit, PointB=geo_8, DirectionB=X)  # -> Geometry, Transform; disabled

# ----
vrot = Rotate(Vector=eval_2.Tangent, Axis=Z_2, Angle=brickrotation)  # -> simplify(Vector); disabled
panel_6 = Panel(addition_2)  # disabled
panel_7 = Panel(lengths_of_curves)  # disabled

# ---- group: Add offset to brick spacing
addition_6 = Addition(A=multiplication_2, B=addition_2)  # disabled

# ----
blendedvectors_x_w_x_b_x_1_w_x_f_x_2 = BlendedVectorsXWXBX1WXFX_2(A=brickvectors_x_2, A_2=framevectors_x_2, data=weight_x_2)
Z_3 = UnitZ(Factor=1)
brick_width_ft_2 = Data(division_2)
brick_depth_ft_2 = Data(division_4)
rad = Radians(Degrees=Slider(90, range=-100..100))
notes = Panel("using blended vectors ")
notes_2 = Panel(notes)

# ---- group: Cull list to target length
smaller = SmallerThan(FirstNumber=addition_6, SecondNumber=subtraction_4)  # -> SmallerThan, OrEqualTo; disabled
cull = CullPattern(List=addition_6, CullPattern=smaller.OrEqualTo)  # disabled

# ----
vrot_2 = Rotate(Vector=blendedvectors_x_w_x_b_x_1_w_x_f_x, Axis=Z_3, Angle=rad)
brickwidth_x_cos_th_bw_1_cos_th_bw = BrickWidthXCosThBW1CosThBW(A=brickvectors_x_2, B=blendedvectors_x_w_x_b_x_1_w_x_f_x_2, B_2=brick_width_ft_2, B_3=brick_depth_ft_2)  # -> simplify(R)
path = ConstructPath(Indices=[Slider(0, range=0..1), Slider(1, range=0..1)])
branch_2 = TreeBranch(Tree=curvelenatparam, Path=path, MaintainPaths=True)
branch_3 = TreeBranch(Tree=brickwidth_x_cos_th_bw_1_cos_th_bw, Path=path, MaintainPaths=True)

# ---- group: Calculate remainder and add to spacing list
item_3 = ListItem(List=reverse(cull), Index=0, Wrap=True)  # disabled
lng_5 = ListLength(List=cull)  # disabled
subtraction_5 = Subtraction(A=subtraction_4, B=simplify(item_3))  # disabled
division_10 = Division(A=subtraction_5, B=simplify(lng_5))  # disabled
series_4 = Series(Start=0, Step=division_10, Count=simplify(lng_5))  # -> simplify(Series); disabled
addition_7 = Addition(A=cull, B=series_4)  # -> simplify(Result); disabled

# ----
viewer = ParamViewer(division_10)  # disabled
python_2 = PythonScript(BrickWidth=brick_width_ft_2, samplingLens=branch_2, samplingBWs=branch_3)  # -> out, BrickPTs; inputs samplingLens: list, samplingBWs: list
# ---------- python_2: Python ----------
brickSamplePts = []
bricksSoFar = 0
for i in xrange(len(samplingLens)):
    #print samplingLens[i], ">=", bricksSoFar, "*", BrickWidth, "or", (bricksSoFar * BrickWidth)
    if(samplingLens[i] >= bricksSoFar * BrickWidth):
        brickSamplePts.append(samplingLens[i])
        bricksSoFar += 1
        print "brick #", bricksSoFar, "at", i, "or", samplingLens[i], "along curve"
        
#for i in xrange(10): # this should be do/while but grasshopper can't break out of python so thsi is a failsafe
BrickPTs = brickSamplePts
# ---------- end python_2 ----------
placebricks = BooleanToggle(True)
panel_8 = Panel(brickwidth_x_cos_th_bw_1_cos_th_bw)
number_slider_10 = Slider(45, range=0..100)  # disabled
initgeocenterptground = InitGeoCenterPtGround(G=filter)
item_4 = ListItem(AllContours=contour, Index=0, Wrap=True)  # -> flatten(Item); disabled
panel_9 = Panel(python_2.BrickPTs)
level_logic = Integer(mod)  # disabled
panel_10 = Panel("1")  # disabled
panel_11 = Panel("2")  # disabled
dam = DataDam(DataA=initgeocenterptground, BufferDelay=100000000, BufferMode=0)
placebricks_2 = PlaceBricks(brick=brick, brick_center=brick_center, brick_axis=brick_axis, point=eval.Point, vector=vrot_2, G=placebricks)
rad_2 = Radians(Degrees=number_slider_10)  # disabled
lng_6 = ListLength(List=item_4)  # disabled
multiplication_6 = Multiplication(A=level_logic, B=panel_11)  # disabled
range = Range(Domain=rad_2, Steps=lng_6)  # -> simplify(graft(Range)); disabled
subtraction_6 = Subtraction(A=multiplication_6, B=panel_10)  # disabled

geometrycenterpt = Geometry(dam)
geometrytomove = Geometry(placebricks_2)

# ---- group: NecessaryInputs
geometrycenterpt_2 = Geometry(geometrycenterpt)
geometrytomove_2 = Geometry(geometrytomove)

# ---- group: Brick geometry inputs
brick_center_3 = Point(brick_center)  # disabled
brick_axis_3 = Point(brick_axis)  # disabled
brick_3 = Mesh(brick)  # disabled

# ----
Z_4 = UnitZ(Factor=1)  # disabled
eval_4 = EvaluateLength(Normalized=True)  # -> Point, Tangent, Parameter; disabled

showcurves_2 = BooleanToggle(False)
contourlines_2 = Geometry(contourlines)
filter_5 = StreamFilter(Gate=showcurves_2, Stream1=contourlines_2)
preview_2 = CustomPreview(Geometry=filter_5, Shader=ColourSwatch(SwatchColor=RGB(0, 255, 170)))

showbricklines = BooleanToggle(False)
showblendedvectors = BooleanToggle(False)
showframevectors = BooleanToggle(False)
showbrickvectors = BooleanToggle(False)
geo_9 = Geometry(eval.Point)
brickpointspython = Data()  # disabled
placedbrickgeometrypython = Geometry()  # disabled
curve_geometry = Geometry(branch)  # disabled
filter_6 = StreamFilter(Gate=showblendedvectors, Stream1=blendedvectors_x_w_x_b_x_1_w_x_f_x)
filter_7 = StreamFilter(Gate=showframevectors, Stream1=framevectors_x)
filter_8 = StreamFilter(Gate=showbrickvectors, Stream1=brickvectors_x)
analyzeplacedbricks = BooleanToggle(False)  # disabled
vdisex = VectorDisplayEx(Point=geo_9, Vector=filter_6, Colour=ColourSwatch(SwatchColor=RGB(247, 23, 255)), Width=Slider(3.4, range=0..10))
vdisex_2 = VectorDisplayEx(Point=geo_9, Vector=filter_7, Colour=ColourSwatch(SwatchColor=RGB(23, 255, 224)), Width=Slider(3.4, range=0..10))
vdisex_3 = VectorDisplayEx(Point=geo_9, Vector=filter_8, Colour=ColourSwatch(SwatchColor=RGB(255, 23, 23)), Width=Slider(3.4, range=0..10))
analyze = Boolean(analyzeplacedbricks)  # disabled
placebricks_3 = BooleanToggle(True)  # disabled
bake = Button()  # disabled
showpoints = BooleanToggle(False)  # disabled
placebricks_4 = Boolean(placebricks_3)  # disabled
swatch = ColourSwatch(SwatchColor=RGB(255, 112, 112))  # disabled
swatch_2 = ColourSwatch(SwatchColor=RGBA(133, 133, 133, 238))  # disabled
swatch_3 = ColourSwatch(SwatchColor=RGBA(32, 43, 38, 238))  # disabled
number_slider_11 = Slider(1, range=0..1)  # disabled

pipeline = GeometryPipeline(
    GroupByLayer=False,
    GroupByType=False,
    IncludeHidden=True,
    IncludeLocked=True,
    LayerFilter="TABLE",
    NameFilter="*",
    TypeFilter=4)
iterate = Button()
bangcounter = BangCounter(G=iterate)
baketrigger = Boolean(iterate)
dam_2 = DataDam(DataA=bangcounter, BufferDelay=20000000, BufferMode=2)
baketrigger_2 = Boolean(baketrigger)

# ---- group: MakeTable
tableboundary = Slider(33, range=0..100)
tableboundary_2 = Geometry(pipeline)
gridspacing = Slider(29, range=0..200)
drawtable = DrawTable(geo=tableboundary_2)
displaygeo = Geometry(flatten(drawtable))
tablepoints = TablePoints(C=tableboundary_2, x=tableboundary, num=gridspacing)
preview_3 = CustomPreview(Geometry=displaygeo, Shader=ColourSwatch(SwatchColor=RGB(252, 252, 252)))

# ----
tablepoint = ListItem(List=tablepoints, Index=dam_2, Wrap=True)
movetopt = Geometry(tablepoint)
vec2pt_2 = Vector2Pt(PointA=geometrycenterpt_2, PointB=movetopt, Unitize=False)  # -> Vector, Length
pinupmovevector = Vector(vec2pt_2.Vector)

pinupmovevector_2 = Vector(pinupmovevector)
synccameras = BooleanToggle(False)
not_2 = GateNot(A=synccameras)
timer = Timer(TimerInterval=50, Target=[timerlock_unlock, getfloundercamera, syncfloundercamera])  # disabled
getfloundercamera = GetFlounderCamera(Activate=synccameras, ViewportName="InterfaceView")  # -> Location, Target, Lens, Up
move = Move(Geometry=getfloundercamera.Target, Motion=pinupmovevector_2)  # -> Geometry, Transform
move_2 = Move(Geometry=getfloundercamera.Location, Motion=pinupmovevector_2)  # -> Geometry, Transform
syncfloundercamera = SyncFlounderCamera(
    Activate=synccameras,
    ViewportName="TableView",
    Location=move_2.Geometry,
    Target=move.Geometry,
    Lens=getfloundercamera.Lens,
    Up=getfloundercamera.Up)

# ---- group: MoveGeometry
pinupmovevector_3 = Vector(pinupmovevector)
move_3 = Move(Geometry=geometrytomove_2, Motion=pinupmovevector_3)  # -> Geometry, Transform
movedgeometry = Geometry(move_3.Geometry)

# ----
flatten = FlattenTree(Tree=movedgeometry, Path="{0}")
clean_2 = CleanTree(Tree=flatten, CleanInvalid=True, CleanEmpty=False)

# ---- group: Preview'N'Bake
swatch_4 = ColourSwatch(SwatchColor=RGB(120, 230, 255))
bake_2 = ObjectBake(
    BakeToggle=baketrigger_2,
    GeometryObjects=flatten(clean_2),
    Layer="PinupBricks",
    ObjectName="GH_Obj",
    ObjectColor=swatch_4,
    LayerColor=RGB(255, 255, 255))

# ----
preview_4 = CustomPreview(Geometry=movedgeometry, Shader=swatch_4)
movetopt_2 = Geometry(movetopt)
move_4 = Move(Geometry=movetopt_2, Motion=multiplication_3)  # -> Geometry, Transform
baketrigger_3 = Boolean(baketrigger)
justified_text = JustifiedText3d(
    Location=move_4.Geometry,
    Text=notes_2,
    Size=Slider(1.1, range=0..10),
    Color=ColourSwatch(SwatchColor=RGB(0, 0, 0)),
    HorizontalAlignment=1,
    VerticalAlginment=1,
    UseMeshes=False,
    Bake=baketrigger_3)

pipeline_2 = GeometryPipeline(
    GroupByLayer=False,
    GroupByType=False,
    IncludeHidden=True,
    IncludeLocked=True,
    LayerFilter="FRAMES",
    NameFilter="*",
    TypeFilter=1073741848)
geo_10 = Geometry(pipeline_2)
baketrigger_4 = Boolean(baketrigger)
swatch_5 = ColourSwatch(SwatchColor=RGB(183, 120, 255))

# ---- group: MoveGeometry
pinupmovevector_4 = Vector(pinupmovevector)
move_5 = Move(Geometry=geo_10, Motion=pinupmovevector_4)  # -> Geometry, Transform
movedgeometry_2 = Geometry(move_5.Geometry)

# ----
bake_3 = ObjectBake(
    BakeToggle=baketrigger_4,
    GeometryObjects=flatten(movedgeometry_2),
    Layer="PinupFrames",
    ObjectName="GH_Obj",
    ObjectColor=swatch_5,
    LayerColor=RGB(255, 255, 255))
preview_5 = CustomPreview(Geometry=movedgeometry_2, Shader=swatch_5)

# ---- group: DisableTimers
disabletimers = Boolean(not_2)

# ---- group: DisableTimers / DataDamBang
bool = Boolean(disabletimers)
dam_3 = DataDam(DataA=bool, BufferDelay=2500000, BufferMode=2)
equals = Equality(FirstNumber=dam_3, SecondNumber=bool)  # -> Equality, Inequality
bool_2 = Boolean(equals.Inequality)

# ---- group: DisableTimers (continued)
timerlock_unlock = VBScript(Check=bool_2, DisableTimers=disabletimers)  # -> out
# ---------- timerlock_unlock: VB ----------
    If (Check) Then
      'We need to disable the timer that is associated with this VB component.
      'First, find the document that contains this VB component
      Dim ghdoc As GH_Document = owner.OnPingDocument()
      If (ghdoc Is Nothing) Then Return
      'Then, iterate over all objects in the document to find all timers.
      For Each docobj As IGH_DocumentObject In ghdoc.Objects
        'Try to cast the object to a GH_Timer
        Dim timer As Special.GH_Timer = TryCast(docobj, Special.GH_Timer)
        If (timer Is Nothing) Then Continue For
        'If the cast was successful, then see if this component is
        'part of the timer target list.
        If (timer.Targets.Contains(owner.InstanceGuid)) Then

          'If it is,

          If(DisableTimers) Then
            'lock the timer.
            print("Timer Locked")
            timer.Locked = True
          Else
            print("Timer Unlocked")
            Timer.Locked = False
          End If

        End If
      Next
    End If
# ---------- end timerlock_unlock ----------

# ---- group: Instantiate Brick Geometry
brickpattern = Number(addition_7)  # disabled
toggle = BooleanToggle(False)  # disabled
curve_geometry_2 = Geometry(branch)  # disabled
vec2pt_3 = Vector2Pt(PointA=brick_center_3, PointB=brick_axis_3, Unitize=False)  # -> Vector, Length; disabled
eval_5 = EvaluateLength(Curve=graft(curve_geometry_2), Length=brickpattern, Normalized=toggle)  # -> Point, Tangent, Parameter; disabled
unit_2 = UnitVector(Vector=vec2pt_3.Vector)  # disabled

# ----
panel_12 = Panel(curve_geometry_2)  # disabled
pshift = ShiftPaths(Data=eval_5.Point, Offset=-1)  # disabled
pshift_2 = ShiftPaths(Data=eval_5.Tangent, Offset=-1)  # disabled
brickpointsgh = Data(pshift)  # disabled
filter_9 = StreamFilter(Gate=python_t_gh_f, Stream0=brickpointsgh, Stream1=brickpointspython)  # disabled
brickpoints = Data(filter_9)  # disabled
filter_10 = StreamFilter(Gate=analyzeplacedbricks, Stream1=brickpoints)  # disabled
filter_11 = StreamFilter(Gate=showpoints, Stream1=brickpoints)  # disabled
brickpoints_2 = Data(filter_10)  # disabled
preview_6 = CustomPreview(Geometry=filter_11, Shader=swatch)  # disabled

# ---- group: Generate closest point on curve above
path_2 = ConstructPath(Indices=subtraction)  # disabled
path_3 = ConstructPath(Indices=number_slider_2)  # disabled
split_2 = SplitTree(Data=curve_geometry, Masks=flatten(path_3))  # -> Positive, Negative; disabled
split_3 = SplitTree(Data=brickpoints, Masks=flatten(path_2))  # -> Positive, Negative; disabled
lng_7 = ListLength(List=split_3.Negative)  # disabled
lng_8 = ListLength(List=split_2.Negative)  # disabled
dup = DuplicateData(Data=lng_8, Number=lng_7, Order=True)  # -> simplify(graft(Data)); disabled
graft_2 = GraftTree(Tree=split_3.Negative, IncludeEmptyLists=True, IncludeNullItems=True)  # disabled
dup_2 = DuplicateData(Data=graft_2, Number=dup, Order=True)  # -> simplify(Data); disabled
path_mapper = PathMapper(dup_2, source="{A;B}(i)", target="{A;i}")  # disabled
crv_cp = CurveClosestPoint(Point=path_mapper, Curve=graft(split_2.Negative))  # -> Point, Parameter, Distance; disabled
path_mapper_2 = PathMapper(crv_cp.Point, source="{A;B}(i)", target="{A;i}")  # disabled
path_mapper_3 = PathMapper(crv_cp.Distance, source="{A;B}(i)", target="{A;i}")  # disabled
sort = SortList(Keys=path_mapper_3, ValuesA=path_mapper_2)  # -> Keys, ValuesA; disabled
panel_13 = Panel("0")  # disabled
item_5 = ListItem(List=sort.ValuesA, Index=panel_13, Wrap=True)  # disabled

# ---- group: Generate closest points on level above
path_4 = ConstructPath(Indices=subtraction)  # disabled
path_5 = ConstructPath(Indices=number_slider_2)  # disabled
number_slider_12 = Slider(2, range=0..30)  # disabled
split_4 = SplitTree(Data=brickpoints_2, Masks=flatten(path_5))  # -> Positive, Negative; disabled
split_5 = SplitTree(Data=brickpoints_2, Masks=flatten(path_4))  # -> Positive, Negative; disabled
cps = ClosestPoints(Point=split_5.Negative, Cloud=split_4.Negative, Count=number_slider_12)  # -> ClosestPoint, CPIndex, Distance; disabled

# ----
panel_14 = Panel(cps.CPIndex)  # disabled

# ---- group: Generate closest point distances in XY plane
pdecon = Deconstruct(Point=graft(split_3.Negative))  # -> XComponent, YComponent, ZComponent; disabled
pdecon_2 = Deconstruct(Point=graft(item_5))  # -> XComponent, YComponent, ZComponent; disabled
pt_3 = ConstructPoint(XCoordinate=pdecon_2.XComponent, YCoordinate=pdecon_2.YComponent, ZCoordinate=0)  # disabled
pt_4 = ConstructPoint(XCoordinate=pdecon.XComponent, YCoordinate=pdecon.YComponent, ZCoordinate=0)  # disabled
dist_2 = Distance(PointA=pt_3, PointB=pt_4)  # -> simplify(Distance); disabled

# ---- group: Specify Rotation Type
rotation_by_level = Number(range)  # disabled

# ----
brick_width_inch = Data(division_2)
brickpoints_3 = Geometry(eval.Point)
swatch_6 = ColourSwatch(SwatchColor=RGB(252, 242, 91))

filter_12 = StreamFilter(Gate=showbricklines, Stream1=brickpoints_3)

mirroredline = MirroredLine(V=vrot_2, G=filter_12, num=brick_width_inch)
preview_7 = CustomPreview(Geometry=filter_12, Shader=swatch_6)
previewlw = CustomPreviewLineweights(Geometry=mirroredline, Shader=swatch_6, Thickness=Slider(3, range=0..10))

# ---- group: Generate closest point distances in XY plane
panel_15 = Panel("1")  # disabled
item_6 = ListItem(List=cps.ClosestPoint, Index=panel_15, Wrap=True)  # disabled
pdecon_3 = Deconstruct(Point=split_5.Negative)  # -> XComponent, YComponent, ZComponent; disabled
pt_5 = ConstructPoint(XCoordinate=pdecon_3.XComponent, YCoordinate=pdecon_3.YComponent, ZCoordinate=0)  # disabled

# ----
pshift_3 = ShiftPaths(Data=item_6, Offset=-1)  # disabled

# ---- group: Generate closest point distances in XY plane (continued)
pdecon_4 = Deconstruct(Point=pshift_3)  # -> XComponent, YComponent, ZComponent; disabled
pt_6 = ConstructPoint(XCoordinate=pdecon_4.XComponent, YCoordinate=pdecon_4.YComponent, ZCoordinate=0)  # disabled
dist_3 = Distance(PointA=pt_6, PointB=pt_5)  # -> simplify(Distance); disabled

# ---- group: Find neighbor distance
panel_16 = Panel("0")  # disabled
item_7 = ListItem(List=cps.CPIndex, Index=panel_16, Wrap=True)  # disabled
split_6 = SplitTree(Data=dist_3, Masks=flatten(path_5))  # -> Positive, Negative; disabled
pshift_4 = ShiftPaths(Data=item_7, Offset=-1)  # disabled
item_8 = ListItem(List=split_6.Negative, Index=pshift_4, Wrap=True)  # disabled

# ---- group: Test for bearing cutoff distance
number_slider_13 = Slider(1.2, range=0..2)  # disabled
number_slider_14 = Slider(1.2, range=0..2)  # disabled
larger = LargerThan(FirstNumber=item_8, SecondNumber=number_slider_14)  # -> LargerThan, OrEqualTo; disabled
larger_2 = LargerThan(FirstNumber=dist_3, SecondNumber=number_slider_13)  # -> LargerThan, OrEqualTo; disabled
and = GateAnd(A=larger.LargerThan, B=larger_2.LargerThan)  # disabled
addition_8 = Addition(A=and, B=larger_2.LargerThan)  # disabled
panel_17 = Panel("2")  # disabled
ma_2 = MassAddition(Input=flatten(and))  # -> Result, PartialResults; disabled
division_11 = Division(A=addition_8, B=panel_17)  # disabled

# ---- group: Remap maximum bearing
number_slider_15 = Slider(2, range=0..2)  # disabled
sort_2 = SortList(Keys=flatten(dist_3))  # -> Keys, ValuesA; disabled
item_9 = ListItem(List=sort_2.Keys, Index=0, Wrap=True)  # disabled
dom_4 = ConstructDomain(DomainStart=item_9, DomainEnd=number_slider_15)  # disabled
remap_2 = RemapNumbers(Value=dist_3, Source=dom_4, Target=Domain(0, 1))  # -> Mapped, Clipped; disabled

# ----
failed_bricks = Panel(ma_2.Result)  # disabled

# ---- group: Remove top row
smaller_2 = SmallerThan(FirstNumber=dist_2, SecondNumber=number_slider_11)  # -> SmallerThan, OrEqualTo; disabled
pshift_5 = ShiftPaths(Data=smaller_2.SmallerThan, Offset=-1)  # disabled
cull_2 = CullPattern(List=dist_2, CullPattern=smaller_2.SmallerThan)  # disabled

# ---- group: Remap 0ffset
number_slider_16 = Slider(0.2, range=0..2)  # disabled
sort_3 = SortList(Keys=flatten(cull_2))  # -> Keys, ValuesA; disabled
item_10 = ListItem(List=sort_3.Keys, Index=0, Wrap=True)  # disabled

# ----
item_11 = ListItem(List=reverse(sort_3.Keys), Index=0, Wrap=True)  # disabled

# ---- group: Remap 0ffset (continued)
dom_5 = ConstructDomain(DomainStart=item_10, DomainEnd=item_11)  # disabled
remap_3 = RemapNumbers(Value=cull_2, Source=dom_5, Target=Domain(0, 1))  # -> Mapped, Clipped; disabled

# ----
pshift_6 = ShiftPaths(Data=remap_3.Mapped, Offset=-1)  # disabled
multiplication_7 = Multiplication(A=pshift_6, B=rad_2)  # disabled

# ---- group: Specify Rotation Type (continued)
rotation_by_offset = Number(multiplication_7)  # disabled

# ----
multiplication_8 = Multiplication(A=rotation_by_offset, B=subtraction_6)  # disabled
vrot_3 = Rotate(Vector=pshift_2, Axis=Z_4, Angle=multiplication_8)  # disabled

# ---- group: Instantiate Brick Geometry (continued)
orient_2 = OrientDirection(Geometry=brick_3, PointA=brick_center_3, DirectionA=unit_2, PointB=pshift, DirectionB=vrot_3)  # -> Geometry, Transform; disabled

# ----
placedbrickgeometrygh = Geometry(orient_2.Geometry)  # disabled
filter_13 = StreamFilter(Gate=python_t_gh_f, Stream0=placedbrickgeometrygh, Stream1=placedbrickgeometrypython)  # disabled
placedbrickgeometry = Geometry(filter_13)  # disabled
filter_14 = StreamFilter(Gate=analyzeplacedbricks, Stream1=placedbrickgeometry)  # disabled
filter_15 = StreamFilter(Gate=placebricks_4, Stream1=placedbrickgeometry)  # disabled
medges = MeshEdges(Mesh=flatten(filter_15))  # -> NakedEdges, InteriorEdges, NonManifoldEdges; disabled
placedbrickgeometry_2 = Geometry(filter_14)  # disabled
bake_4 = ObjectBake(
    BakeToggle=bake,
    GeometryObjects=placedbrickgeometry,
    Layer="GH_Bake",
    ObjectName="GH_Obj",
    ObjectColor=swatch,
    LayerColor=RGB(255, 255, 255))  # disabled
preview_8 = CustomPreview(Geometry=filter_15, Shader=swatch_3)  # disabled
preview_9 = CustomPreview(Geometry=[medges.NakedEdges, medges.InteriorEdges, medges.NonManifoldEdges], Shader=swatch_2)  # disabled

# ---- group: Remove top row (continued)
brick_geometry = Mesh(placedbrickgeometry_2)  # disabled
cull_3 = CullPattern(List=brick_geometry, CullPattern=pshift_5)  # disabled

# ----
brick_geometry_2 = Mesh(placedbrickgeometry_2)  # disabled

# ---- group: Create output geometry
gradient = Gradient(LowerLimit=0, UpperLimit=1, Parameter=flatten(division_11), stops=[0.424: RGB(92, 165, 204), 0.788: RGB(255, 0, 0)])  # disabled
brick_geometry_3 = Mesh(flatten(brick_geometry_2))  # disabled
mcol = MeshColours(Mesh=graft(brick_geometry_3), Colours=graft(gradient))  # disabled
medges_2 = MeshEdges(Mesh=mcol)  # -> NakedEdges, InteriorEdges, NonManifoldEdges; disabled
swatch_7 = ColourSwatch(SwatchColor=RGB(61, 61, 61))  # disabled
preview_10 = CustomPreview(Geometry=[medges_2.NakedEdges, medges_2.InteriorEdges], Shader=swatch_7)  # disabled

gradient_2 = Gradient(
    LowerLimit=0,
    UpperLimit=1,
    Parameter=flatten(remap_3.Mapped),
    stops=[0: RGB(0, 128, 0), 0.419: RGB(255, 255, 0), 1: RGB(255, 0, 0)])  # disabled
brick_geometry_4 = Mesh(flatten(cull_3))  # disabled
mcol_2 = MeshColours(Mesh=graft(brick_geometry_4), Colours=graft(gradient_2))  # disabled

# ----
preview_11 = CustomPreview(Geometry=flatten(split_3.Negative), Shader=gradient)  # disabled
preview_12 = CustomPreview(Geometry=flatten(split_3.Negative), Shader=gradient_2)  # disabled
lng_9 = ListLength(List=brick_geometry_3)  # disabled
total_bricks = Panel(lng_9)  # disabled
division_12 = Division(A=failed_bricks, B=total_bricks)  # disabled
multiplication_9 = Multiplication(A="100", B=division_12)
round_2 = Round(Number=multiplication_9)  # -> Nearest, Floor, Ceiling
concat = Concatenate(FragmentA=round_2.Nearest, FragmentB="% failure")
panel_18 = Panel(concat)

# ==== cluster HorizontalCurves
geo = ClusterInput()
geo_2 = Geometry(geo)
planar = Planar(Curve=geo_2)  # -> Planar, Plane, Deviation
xy = XYPlane(Origin=Point(0, 0, 0))
dprod = DotProduct(VectorA=planar.Plane, VectorB=xy, Unitize=False)
xprod = CrossProduct(VectorA=planar.Plane, VectorB=xy, Unitize=False)  # -> Vector, Length
abs = Absolute(Value=dprod)
panel = Panel("1")
larger = LargerThan(FirstNumber=abs, SecondNumber=Slider(0.5, range=0..1))  # -> LargerThan, OrEqualTo
dispatch = Dispatch(List=geo_2, DispatchPattern=larger.LargerThan)  # -> simplify(ListA), simplify(ListB)
panel_2 = Panel(dispatch.ListA)
A = ClusterOutput(dispatch.ListA)
B = ClusterOutput(dispatch.ListB)

# ==== cluster PlanrVecTowardsCenter
pt = ClusterInput()
P = ClusterInput()
pt_2 = Point(pt)
pdecon = Deconstruct(Point=P)  # -> XComponent, YComponent, ZComponent
pdecon_2 = Deconstruct(Point=pt_2)  # -> XComponent, YComponent, ZComponent
pt_3 = ConstructPoint(XCoordinate=pdecon.XComponent, YCoordinate=pdecon.YComponent, ZCoordinate=pdecon_2.ZComponent)
vec2pt = Vector2Pt(PointA=pt_2, PointB=pt_3, Unitize=False)  # -> Vector, Length
unit = UnitVector(Vector=vec2pt.Vector)
V = ClusterOutput(unit)

# ==== cluster GetAlignVectors
C = ClusterInput()
geo = ClusterInput()
end = EndPoints(Curve=graft(C))  # -> Start, End
geo_2 = Geometry(geo)
geo_3 = Geometry(C)
item = ListItem(List=C, Index=0, Wrap=True)
sort_pt = SortPoints(Points=[end.Start, end.End])  # -> Points, Indices
split = SplitList(List=sort_pt.Points, Index="1")  # -> ListA, ListB
panel = Panel(split.ListA)
item_2 = ListItem(List=reverse(geo_2), Index=0, Wrap=True)
item_3 = ListItem(List=geo_2, Index=0, Wrap=True)
pt = Point(split.ListB)
pdecon = Deconstruct(Point=split.ListA)  # -> XComponent, YComponent, ZComponent
pdecon_2 = Deconstruct(Point=pt)  # -> XComponent, YComponent, ZComponent
end_2 = EndPoints(Curve=item_3)  # -> Start, End
crv_cp = CurveClosestPoint(Point=end_2.Start, Curve=C)  # -> Point, Parameter, Distance
end_3 = EndPoints(Curve=item_2)  # -> Start, End
pt_2 = ConstructPoint(XCoordinate=pdecon.XComponent, YCoordinate=pdecon.YComponent, ZCoordinate=pdecon_2.ZComponent)
geo_4 = Geometry(end_2.End)
vec2pt = Vector2Pt(PointA=pt_2, PointB=pt, Unitize=False)  # -> Vector, Length
vec2pt_2 = Vector2Pt(PointA=end_2.End, PointB=end_3.End, Unitize=False)  # -> Vector, Length
vec2pt_3 = Vector2Pt(PointA=end_2.Start, PointB=end_3.Start, Unitize=False)  # -> Vector, Length
vdis = VectorDisplay(Anchor=split.ListA, Vector=vec2pt.Vector)
unit = UnitVector(Vector=vec2pt.Vector)  # -> simplify(flatten(Vector))
devec = DeconstructVector(Vector=vec2pt_3.Vector)  # -> XComponent, YComponent, ZComponent
devec_2 = DeconstructVector(Vector=vec2pt_2.Vector)  # -> XComponent, YComponent, ZComponent
vec = VectorXYZ(XComponent=devec.XComponent, YComponent=devec.YComponent, ZComponent=0)  # -> Vector, Length
vec_2 = VectorXYZ(XComponent=devec_2.XComponent, YComponent=devec_2.YComponent, ZComponent=0)  # -> Vector, Length
line = LineSDL(Start=end_2.Start, Direction=vec.Vector, Length=1)
line_2 = LineSDL(Start=end_2.End, Direction=vec_2.Vector, Length=1)
llx = LineLine(Line1=line, Line2=line_2)  # -> ParamA, ParamB, PointA, PointB
vec2pt_4 = Vector2Pt(PointA=end_2.End, PointB=llx.PointB, Unitize=False)  # -> Vector, Length
vec2pt_5 = Vector2Pt(PointA=end_2.Start, PointB=llx.PointA, Unitize=False)  # -> Vector, Length
unit_2 = UnitVector(Vector=vec2pt_4.Vector)
unit_3 = UnitVector(Vector=vec2pt_5.Vector)
vdis_2 = VectorDisplay(Anchor=end_2.End, Vector=unit_2)
vdis_3 = VectorDisplay(Anchor=end_2.Start, Vector=unit_3)
V = ClusterOutput(unit_2)
V_2 = ClusterOutput(unit_3)
panel_2 = Panel(vec.Vector)

# ==== cluster Cluster
geo = ClusterInput()
geo_2 = Geometry(geo)
end = EndPoints(Curve=geo_2)  # -> Start, End
vec2pt = Vector2Pt(PointA=end.Start, PointB=end.End, Unitize=False)  # -> Vector, Length
geo_3 = ClusterOutput(geo_2)
vdis = VectorDisplay(Anchor=end.Start, Vector=vec2pt.Vector)

# ==== cluster PlaceBricks
point = ClusterInput()
vector = ClusterInput()
brick_center = ClusterInput()
G = ClusterInput()
brick_axis = ClusterInput()
brick = ClusterInput()
point_2 = Geometry(point)
vector_2 = Data(vector)

# ---- group: Instantiate Brick Geometry / Brick geometry inputs
brick_center_2 = Point(brick_center)
brick_axis_2 = Point(brick_axis)
brick_2 = Mesh(brick)

# ----
geo = Geometry(simplify(point_2))
filter = StreamFilter(Gate=G, Stream1=brick_2)

# ---- group: Instantiate Brick Geometry
vec2pt = Vector2Pt(PointA=brick_center_2, PointB=brick_axis_2, Unitize=False)  # -> Vector, Length
vec = Vector(vector_2)
unit = UnitVector(Vector=vec2pt.Vector)
orient = OrientDirection(Geometry=filter, PointA=brick_center_2, DirectionA=unit, PointB=geo, DirectionB=vec)  # -> Geometry, Transform

# ----
G_2 = ClusterOutput(orient.Geometry)

# ==== cluster WeightX
A = ClusterInput()
subtraction = Subtraction(A=A, B="0.5")
abs = Absolute(Value=subtraction)
sqr = Square(Value=abs)
multiplication = Multiplication(A=abs, B="2")
bnd = Bounds(Numbers=sqr)
remap = RemapNumbers(Value=sqr, Source=bnd, Target=Domain(0, 1))  # -> Mapped, Clipped
R = ClusterOutput(remap.Mapped)

# ==== cluster FrameVectorsX
data = ClusterInput()
B = ClusterInput()
B_2 = ClusterInput()
data_2 = Data(data)
subtraction = Subtraction(A="1", B=data_2)
multiplication = Multiplication(A=data_2, B=B_2)
multiplication_2 = Multiplication(A=subtraction, B=B)
panel = Panel(data_2)
averagevectors = AverageVectors(A=multiplication_2, B=multiplication)
V = ClusterOutput(averagevectors)

# ==== cluster BrickVectorsX
V = ClusterInput()
Z = UnitZ(Factor=1)
rad = Radians(Degrees=Slider(-90, range=-100..100))
vrot = Rotate(Vector=V, Axis=Z, Angle=rad)
unit = UnitVector(Vector=vrot)
V_2 = ClusterOutput(unit)

# ==== cluster BlendedVectorsXWXBX1WXFX
A = ClusterInput()
A_2 = ClusterInput()
data = ClusterInput()
data_2 = Data(data)
weights = Panel(data_2)
subtraction = Subtraction(A="1", B=data_2)
data_3 = Data(data_2)
multiplication = Multiplication(A=A_2, B=subtraction)
multiplication_2 = Multiplication(A=A, B=data_3)
averageunitizevectors = AverageVectors(A=multiplication, B=multiplication_2)
V = ClusterOutput(averageunitizevectors)

# ==== cluster DrawTable
geo = ClusterInput()
geo_2 = Geometry(geo)
dim = Dimensions(Surface=geo_2)  # -> UDimension, VDimension
avr = Average(Input=[dim.UDimension, dim.VDimension])
cp = ControlPoints(Curve=geo_2)  # -> Points, Weights, Knots
division = Division(A=avr, B=Slider(40, range=0..40))
Z = UnitZ(Factor=division)
cset = CreateSet(List=cp.Points)  # -> Set, Map
rev = Reverse(Vector=Z)
extr = Extrude(Base=geo_2, Direction=rev)
division_2 = Division(A=avr, B=Slider(8, range=0..100))
line = LineSDL(Start=cset.Set, Direction=rev, Length=division_2)
division_3 = Division(A=avr, B=Slider(100, range=0..100))
cap = CapHoles(Brep=extr)
pipe = Pipe(Curve=line, Radius=division_3, Caps=0)
displaygeo = Geometry(flatten([cap, pipe]))
displaygeo_2 = ClusterOutput(displaygeo)

# ==== cluster TablePoints
C = ClusterInput()
x = ClusterInput()
num = ClusterInput()
num_2 = Number(num)

neg = Negative(Value=x)
offset = Offset(Curve=C, Distance=neg, Plane=PlaneXY(0, 0, 0), Corners=1)
dim = Dimensions(Surface=offset)  # -> UDimension, VDimension
division = Division(A=dim.UDimension, B=num_2)
division_2 = Division(A=dim.VDimension, B=num_2)
sdivide = DivideSurface(Surface=offset, UCount=division, VCount=division_2)  # -> Points, Normals, Parameters

clean = CleanTree(Tree=sdivide.Points, CleanInvalid=True, CleanEmpty=False)
geo = Geometry(flatten(clean))
geo_2 = ClusterOutput(geo)

# ==== cluster BangCounter
G = ClusterInput()
true = Boolean(True)
filter = StreamFilter(Gate=G, Stream1=true)
rec = DataRecorder(filter, DataLimit=-10, RecordData=True)
merge = Merge(Data1=rec, Data2="True")  # -> flatten(Result)
lng = ListLength(List=merge)
L = ClusterOutput(lng)

# ==== cluster InitGeoCenterPtGround
G = ClusterInput()
volume = Volume(Geometry=G)  # -> Volume, flatten(Centroid)
avr = Average(Input=volume.Centroid)
pdecon = Deconstruct(Point=avr)  # -> XComponent, YComponent, ZComponent
pt = ConstructPoint(XCoordinate=pdecon.XComponent, YCoordinate=pdecon.YComponent, ZCoordinate=0)
pt_2 = ClusterOutput(pt)

# ==== cluster MirroredLine
G = ClusterInput()
V = ClusterInput()
num = ClusterInput()
num_2 = Number(num)
division = Division(A=num_2, B="2")
amp = Amplitude(Vector=V, Amplitude=division)
rev = Reverse(Vector=amp)
move = Move(Geometry=G, Motion=rev)  # -> Geometry, Transform
line = LineSDL(Start=move.Geometry, Direction=amp, Length=num_2)
L = ClusterOutput(line)

# ==== cluster GetAlignVectorsFromFrame
geo = ClusterInput()
geo_2 = Geometry(geo)
panel = Panel("Order matters")
aligncurvesbottomup = AlignCurvesBottomUp(geo=geo_2)
geo_3 = Geometry(aligncurvesbottomup)
end = EndPoints(Curve=geo_3)  # -> Start, End
xyvec2pt = XYVec2Pt(P=end.Start, pt=end.End)
start_ground_points = Geometry(end.Start)
vec = Vector(xyvec2pt)
item = ListItem(List=reverse(vec), Index=0, Wrap=True)
item_2 = ListItem(List=vec, Index=0, Wrap=True)
item_3 = ListItem(List=reverse(start_ground_points), Index=0, Wrap=True)
item_4 = ListItem(List=start_ground_points, Index=0, Wrap=True)
line = LineSDL(Start=item_4, Direction=item_2, Length=1)  # -> simplify(Line)
line_2 = LineSDL(Start=item_3, Direction=item, Length=1)  # -> simplify(Line)
llx = LineLine(Line1=line, Line2=line_2)  # -> ParamA, ParamB, PointA, PointB
vec2pt = Vector2Pt(PointA=item_4, PointB=llx.PointA, Unitize=False)  # -> Vector, Length
vec2pt_2 = Vector2Pt(PointA=item_3, PointB=llx.PointB, Unitize=False)  # -> Vector, Length
unit = UnitVector(Vector=vec2pt.Vector)  # -> simplify(Vector)
unit_2 = UnitVector(Vector=vec2pt_2.Vector)  # -> simplify(Vector)
V = ClusterOutput(unit)
V_2 = ClusterOutput(unit_2)

# ==== cluster CoursingPattern
brick_width_inch = ClusterInput()
data = ClusterInput()
geo = ClusterInput()
brick_width_inch_2 = Data(brick_width_inch)
data_2 = Data(data)
division = Division(A=brick_width_inch_2, B=data_2)
geo_2 = Geometry(geo)
B = ClusterInput()
series = Series(Start=0, Step=division, Count=data_2)
len = Length(Curve=geo_2)
addition = Addition(A=brick_width_inch_2, B=B)
stepamount = Panel(series)
division_2 = Division(A=len, B=addition)
number_slider = Slider(3, range=0..10)
round = Round(Number=division_2)  # -> Nearest, Floor, Ceiling
data_3 = Data(round.Ceiling)
tstat = TreeStatistics(Tree=data_3)  # -> Paths, Length, Count
panel = Panel(tstat.Count)
repeat = RepeatData(Data=series, Length=tstat.Count)  # -> simplify(graft(Data))
series_2 = Series(Start=simplify(repeat), Step=addition, Count=round.Ceiling)  # -> simplify(Series)
panel_2 = Panel(repeat)
S = ClusterOutput(series_2)

# ==== cluster BrickVectorsX_2
Z = UnitZ(Factor=1)
V = ClusterInput()
rad = Radians(Degrees=Slider(-90, range=-100..100))
vrot = Rotate(Vector=V, Axis=Z, Angle=rad)
unit = UnitVector(Vector=vrot)
V_2 = ClusterOutput(unit)

# ==== cluster BlendedVectorsXWXBX1WXFX_2
data = ClusterInput()
data_2 = Data(data)
weights = Panel(data_2)
subtraction = Subtraction(A="1", B=data_2)
A = ClusterInput()
A_2 = ClusterInput()
data_3 = Data(data_2)
multiplication = Multiplication(A=A, B=subtraction)
multiplication_2 = Multiplication(A=A_2, B=data_3)
averageunitizevectors = AverageVectors(A=multiplication, B=multiplication_2)
V = ClusterOutput(averageunitizevectors)

# ==== cluster BrickWidthXCosThBW1CosThBW
A = ClusterInput()
B = ClusterInput()
B_2 = ClusterInput()
B_3 = ClusterInput()
xy = XYPlane(Origin=Point(0, 0, 0))
angle = Angle(VectorA=A, VectorB=B, Plane=xy)  # -> Angle, Reflex
cos = Cosine(Value=angle.Angle)
abs = Absolute(Value=cos)
subtraction = Subtraction(A="1", B=abs)
multiplication = Multiplication(A=abs, B=B_2)
multiplication_2 = Multiplication(A=subtraction, B=B_3)
addition = Addition(A=multiplication, B=multiplication_2)
R = ClusterOutput(addition)

# ==== cluster NormalizedSeries
num = ClusterInput()
num_2 = Number(num)
division = Division(A="1.0", B=num_2)
addition = Addition(A=num_2, B="1")
series = Series(Start=0, Step=division, Count=addition)
S = ClusterOutput(series)

# ==== cluster CurveLenAtParam
C = ClusterInput()
B = ClusterInput()
len = Length(Curve=C)
multiplication = Multiplication(A=len, B=B)
R = ClusterOutput(multiplication)

# ==== cluster AverageVectors
A = ClusterInput()
B = ClusterInput()
addition = Addition(A=A, B=B)
division = Division(A=addition, B="2")
unit = UnitVector(Vector=division)
V = ClusterOutput(unit)

# ==== cluster XYVec2Pt
P = ClusterInput()
pt = ClusterInput()
pt_2 = Point(pt)
pdecon = Deconstruct(Point=P)  # -> XComponent, YComponent, ZComponent
pdecon_2 = Deconstruct(Point=pt_2)  # -> XComponent, YComponent, ZComponent
pt_3 = ConstructPoint(XCoordinate=pdecon.XComponent, YCoordinate=pdecon.YComponent, ZCoordinate=pdecon_2.ZComponent)
panel = Panel(pt_3)
vec2pt = Vector2Pt(PointA=pt_3, PointB=pt_2, Unitize=False)  # -> simplify(Vector), Length
V = ClusterOutput(vec2pt.Vector)

# ==== cluster AlignCurvesBottomUp
geo = ClusterInput()
geo_2 = Geometry(simplify(geo))
end = EndPoints(Curve=geo_2)  # -> Start, End
pdecon = Deconstruct(Point=end.Start)  # -> XComponent, YComponent, ZComponent
pdecon_2 = Deconstruct(Point=end.End)  # -> XComponent, YComponent, ZComponent
geo_3 = Geometry(simplify(geo))
larger = LargerThan(FirstNumber=pdecon_2.ZComponent, SecondNumber=pdecon.ZComponent)  # -> LargerThan, OrEqualTo
flip = FlipCurve(Curve=geo_3)  # -> Curve, Flag
trueifbottomupcrv = Boolean(larger.OrEqualTo)
p_n_c = PickNChoose(Pattern=trueifbottomupcrv, Stream0=flip.Curve, Stream1=geo_3)
geo_4 = Geometry(p_n_c)
geo_5 = ClusterOutput(geo_4)
panel = Panel(p_n_c)
